# Grasshopper definition 260519_scene_ready_3.gh (Grasshopper 1.0.8)
# plug-ins: Virtual Robot, Cassis, Vizor

md_slider = MDSlider(
    SliderMode=0,
    slider_value=Point(0.4195628283, 0.7255336482, 0.5),
    x_domain=Domain(0, 1),
    y_domain=Domain(0, 1),
    z_domain=Domain(0, 1))
open_gripper = BooleanToggle(False)

# ---- group: Open
mesh = Mesh(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)

# ----
deconstruct = Deconstruct(Point=expr("x*1000", md_slider))  # -> XComponent, YComponent, ZComponent
construct_point = ConstructPoint(XCoordinate=deconstruct.XComponent, YCoordinate=deconstruct.YComponent, ZCoordinate=Slider(150, range=0..1000))

xy_plane = XYPlane(Origin=Point(0, 0, 0))
move = Move(Geometry=xy_plane, Motion="{0,0,157.5}")  # -> Geometry, Transform

button = Button()
wsconnection = WsConnection(Address="ws://localhost:9090", Reset=Button())  # -> WebsocketObject, ConnectionInfo

# ----
# Define Marker
panel = Panel("marker1")
tracked_object = TrackedObject(WebsocketObject=wsconnection.WebsocketObject, Disable=False, DeviceName=panel)  # -> Output, TrackedDevice

# ----
# Define Headset
hololens = Hololens(
    WebsocketObject=wsconnection.WebsocketObject,
    Disable=False,
    DeviceName="HOLO1",
    SkillConfiguration="{\"monitor\": 1, \"screw\": 1, \"pick\": 1, \"place\": 1}")  # -> Output, ARDevice

cassis = Cassis(
    Prefix="http://localhost:3003/mcp/",
    EnabledTools="Edit_CSharp_Script,List_Python_Scripts,Get_Python_Script,Edit_Python_Script,Get_Python_Script_Errors,Edit_Script,Get_AllComponents,Get_ComponentCount,Get_Component_Output,GetAllConnections,List_Panels,Get_Panel_Text,Set_Panel_Text,Get_Components_In_Group,AddComponent,GetSolutionState,Get_Parameter_TypeHints,Add_Script_Parameter,Remove_Script_Parameter")

brep = Brep(<brep referenced from the Rhino model>)
brep_2 = Brep([<brep referenced from the Rhino model> x2])
brep_3 = Brep(<brep referenced from the Rhino model>)
brep_4 = Brep([<brep referenced from the Rhino model> x2])
brep_5 = Brep(<brep referenced from the Rhino model>)

# ---- group: timing control
range = Range(Domain="1 to 15", Steps="7")

# ---- group: movement path
curve = Curve(<curve referenced from the Rhino model>)

# ----
range_2 = Range(Domain=Domain(0, 1), Steps="7")
graph_mapper = GraphMapper(
    range_2,
    x0=0,
    x1=1,
    y0=-0.1,
    y1=0.1,
    container_name="Sine",
    Equation_px=[0.2544305921, 0.7515841126],
    Equation_py=[0.01207107306, 1])
graph_mapper_2 = GraphMapper(
    range_2,
    x0=0,
    x1=1,
    y0=-0.1,
    y1=0.1,
    container_name="Sine",
    Equation_px=[0.1702104062, 0.5002164245],
    Equation_py=[0.01321691275, 0.9818059802])
vector_xyz = VectorXYZ(XComponent=graph_mapper, YComponent=graph_mapper, ZComponent=graph_mapper_2)  # -> Vector, Length
xy_plane_2 = XYPlane(Origin=vector_xyz.Vector)
animation_keyframe = AnimationKeyframe(Time=range, Pose=xy_plane_2, Scale=Vector(1, 1, 1))

unit_y = UnitY(Factor=1)
divide_curve = DivideCurve(Curve=curve, Count="7", Kinks=False)  # -> Points, Tangents, Parameters
construct_plane = ConstructPlane(Origin=divide_curve.Points, XAxis=divide_curve.Tangents, YAxis=unit_y)
animation_keyframe_2 = AnimationKeyframe(Time=range, Pose=construct_plane, Scale=Vector(1, 1, 1))

xy = XYPlane(Origin=Point(0, 0, 0))
Z = UnitZ(Factor=Slider(0.09, range=0..0.1))
planesrf = PlaneSurface(Plane=xy, XSize=Domain(-10, 10), YSize=Domain(-10, 10))
neg = Negative(Value=Z)
move_2 = Move(Geometry=planesrf, Motion=neg)  # -> Geometry, Transform

# ----
# Motion: MOVE
construct_point_2 = ConstructPoint(XCoordinate=0, YCoordinate=0, ZCoordinate=0)

# ---- group: make sure this is true for listening
toggle = BooleanToggle(True)

# ----
# world model
button_2 = Button()
hologram_model = Python3Script(refresh=toggle, reset=button_2)  # -> out, geometry; inputs refresh: Boolean
# ---------- hologram_model: Python ----------
#! python 3

"""Load hologram_model.json and emit Rhino Brep boxes for Grasshopper preview."""
import json
import os
import shutil

import Rhino.Geometry as rg
import System


def ensure_reset_input():
    component = ghenv.Component
    for param in component.Params.Input:
        if param.Name == "reset" or param.NickName == "reset":
            param.Name = "reset"
            param.NickName = "reset"
            param.Optional = True
            return False
    if component.Params.Input.Count == 0:
        raise RuntimeError("Cannot add reset input without a script input template")
    template = component.Params.Input[0]
    param = System.Activator.CreateInstance(template.GetType())
    param.Name = "reset"
    param.NickName = "reset"
    param.Optional = True
    param.Description = "Wire a Button here to reload hologram_model.json from hologram_model - Copy.json."
    component.Params.RegisterInputParam(param, component.Params.Input.Count)
    component.Params.OnParametersChanged()
    component.ExpireSolution(True)
    return True


def optional_input(name, fallback=None):
    value = globals().get(name, fallback)
    if value is None:
        return fallback
    text = str(value).strip()
    return text if text else fallback


def optional_bool(name, fallback=False):
    value = globals().get(name, fallback)
    if value is None:
        return fallback
    if isinstance(value, bool):
        return value
    text = str(value).strip().lower()
    if not text:
        return fallback
    return text in ("1", "true", "yes", "on")


def point3(values):
    return rg.Point3d(float(values[0]), float(values[1]), float(values[2]))


def unitized(vector, fallback):
    v = rg.Vector3d(vector)
    if v.Length <= 1e-9:
        v = rg.Vector3d(fallback)
    v.Unitize()
    return v


def rotated_axis(quat, axis):
    x, y, z, w = [float(value) for value in quat]
    norm = (x * x + y * y + z * z + w * w) ** 0.5
    if norm <= 1e-9:
        raise ValueError("pose quaternion has zero length")

    x, y, z, w = x / norm, y / norm, z / norm, w / norm
    ax, ay, az = axis

    return rg.Vector3d(
        (1.0 - 2.0 * y * y - 2.0 * z * z) * ax
        + (2.0 * x * y - 2.0 * z * w) * ay
        + (2.0 * x * z + 2.0 * y * w) * az,
        (2.0 * x * y + 2.0 * z * w) * ax
        + (1.0 - 2.0 * x * x - 2.0 * z * z) * ay
        + (2.0 * y * z - 2.0 * x * w) * az,
        (2.0 * x * z - 2.0 * y * w) * ax
        + (2.0 * y * z + 2.0 * x * w) * ay
        + (1.0 - 2.0 * x * x - 2.0 * y * y) * az,
    )


def pose_beam_plane(body, start, end):
    pose = body.get("pose") or {}
    center = point3(pose["xyz"])
    quat = pose["quat_xyzw"]

    x_axis = unitized(rotated_axis(quat, [1.0, 0.0, 0.0]), rg.Vector3d.XAxis)
    y_axis = unitized(rotated_axis(quat, [0.0, 1.0, 0.0]), rg.Vector3d.YAxis)

    length = start.DistanceTo(end)
    if length <= 1e-9:
        raise ValueError("Beam axis has zero length")

    return rg.Plane(center, x_axis, y_axis), length


def beam_to_brep(body, default_section):
    axis = body.get("axis") or {}
    start = point3(axis["start_xyz"])
    end = point3(axis["end_xyz"])
    plane, length = pose_beam_plane(body, start, end)

    dimensions = ((body.get("solid") or {}).get("dimensions") or {})
    section_y = float(dimensions.get("y", default_section.get("y", 0.04)))
    section_z = float(dimensions.get("z", default_section.get("z", 0.04)))

    box = rg.Box(
        plane,
        rg.Interval(-length * 0.5, length * 0.5),
        rg.Interval(-section_y * 0.5, section_y * 0.5),
        rg.Interval(-section_z * 0.5, section_z * 0.5),
    )
    brep = box.ToBrep()
    if brep:
        brep.UserDictionary.Set("common_model_id", body.get("id", ""))
        brep.UserDictionary.Set("common_model_family", body.get("family", ""))
        brep.UserDictionary.Set("common_model_label", body.get("label", ""))
    return brep


gh_path = ghenv.Component.OnPingDocument().FilePath.replace("/", "\\")
gh_dir = gh_path.rsplit("\\", 1)[0]
repo_root = gh_dir.rsplit("\\examples", 1)[0]
DEFAULT_MODEL_PATH = repo_root + r"\server\robot_control\shared_geometry\hologram_model.json"
DEFAULT_RESET_MODEL_PATH = repo_root + r"\server\robot_control\shared_geometry\hologram_model - Copy.json"

added_reset_input = ensure_reset_input()
model_file = optional_input("model_path", DEFAULT_MODEL_PATH)
reset_file = DEFAULT_RESET_MODEL_PATH

if optional_bool("reset"):
    if not os.path.exists(reset_file):
        raise FileNotFoundError("reset model copy not found: {0}".format(reset_file))
    with open(reset_file, "r", encoding="utf-8") as handle:
        json.load(handle)
    shutil.copyfile(reset_file, model_file)
    print("Reset {0} from {1}".format(model_file, reset_file))

if not os.path.exists(model_file):
    raise FileNotFoundError("hologram_model.json not found: {0}".format(model_file))

with open(model_file, "r", encoding="utf-8") as handle:
    model = json.load(handle)

default_section = (((model.get("defaults") or {}).get("solid") or {}).get("section") or {})
breps = []
labels = []

for body in model.get("bodies", []):
    brep = beam_to_brep(body, default_section)
    if brep:
        breps.append(brep)
        labels.append("{0} ({1}): {2}".format(body.get("id"), body.get("family"), body.get("label")))

geometry = breps
a = breps

if added_reset_input:
    print("Added reset input. Wire a Button to it, then press reset to reload the copy JSON.")

print("Loaded {0} beam Breps from {1}".format(len(breps), model_file))
print("Model: {0}".format(model.get("name", "unnamed")))
print("GH file: {0}".format(gh_path))
print("Repo root: {0}".format(repo_root))
print("Model file: {0}".format(model_file))
print("Reset file: {0}".format(reset_file))
# ---------- end hologram_model ----------

# ---- group: physical_model
py3 = Python3Script(refresh=Button(), reset=Button())  # -> out, geometry; inputs refresh: Boolean
# ---------- py3: Python ----------
#! python 3

"""Load physical_model.json and emit Rhino Brep boxes for Grasshopper preview."""
import json
import os
import shutil

import Rhino.Geometry as rg
import System


def ensure_reset_input():
    component = ghenv.Component
    for param in component.Params.Input:
        if param.Name == "reset" or param.NickName == "reset":
            param.Name = "reset"
            param.NickName = "reset"
            param.Optional = True
            return False
    if component.Params.Input.Count == 0:
        raise RuntimeError("Cannot add reset input without a script input template")
    template = component.Params.Input[0]
    param = System.Activator.CreateInstance(template.GetType())
    param.Name = "reset"
    param.NickName = "reset"
    param.Optional = True
    param.Description = "Wire a Button here to reload physical_model.json from physical_model - Copy.json."
    component.Params.RegisterInputParam(param, component.Params.Input.Count)
    component.Params.OnParametersChanged()
    component.ExpireSolution(True)
    return True


def optional_input(name, fallback=None):
    value = globals().get(name, fallback)
    if value is None:
        return fallback
    text = str(value).strip()
    return text if text else fallback


def optional_bool(name, fallback=False):
    value = globals().get(name, fallback)
    if value is None:
        return fallback
    if isinstance(value, bool):
        return value
    text = str(value).strip().lower()
    if not text:
        return fallback
    return text in ("1", "true", "yes", "on")


def point3(values):
    return rg.Point3d(float(values[0]), float(values[1]), float(values[2]))


def unitized(vector, fallback):
    v = rg.Vector3d(vector)
    if v.Length <= 1e-9:
        v = rg.Vector3d(fallback)
    v.Unitize()
    return v


def stable_beam_plane(start, end):
    axis = end - start
    length = axis.Length
    if length <= 1e-9:
        raise ValueError("Beam axis has zero length")

    x_axis = unitized(axis, rg.Vector3d.XAxis)
    up = rg.Vector3d.ZAxis
    ref = rg.Vector3d.YAxis if abs(rg.Vector3d.Multiply(x_axis, up)) > 0.95 else up
    y_axis = rg.Vector3d.CrossProduct(ref, x_axis)
    y_axis = unitized(y_axis, rg.Vector3d.YAxis)

    center = rg.Point3d(
        (start.X + end.X) * 0.5,
        (start.Y + end.Y) * 0.5,
        (start.Z + end.Z) * 0.5,
    )
    return rg.Plane(center, x_axis, y_axis), length


def beam_to_brep(body, default_section):
    axis = body.get("axis") or {}
    start = point3(axis["start_xyz"])
    end = point3(axis["end_xyz"])
    plane, length = stable_beam_plane(start, end)

    dimensions = ((body.get("solid") or {}).get("dimensions") or {})
    section_y = float(dimensions.get("y", default_section.get("y", 0.04)))
    section_z = float(dimensions.get("z", default_section.get("z", 0.04)))

    box = rg.Box(
        plane,
        rg.Interval(-length * 0.5, length * 0.5),
        rg.Interval(-section_y * 0.5, section_y * 0.5),
        rg.Interval(-section_z * 0.5, section_z * 0.5),
    )
    brep = box.ToBrep()
    if brep:
        brep.UserDictionary.Set("common_model_id", body.get("id", ""))
        brep.UserDictionary.Set("common_model_family", body.get("family", ""))
        brep.UserDictionary.Set("common_model_label", body.get("label", ""))
    return brep


gh_path = ghenv.Component.OnPingDocument().FilePath.replace("/", "\\")
gh_dir = gh_path.rsplit("\\", 1)[0]
repo_root = gh_dir.rsplit("\\examples", 1)[0]
DEFAULT_MODEL_PATH = repo_root + r"\server\robot_control\shared_geometry\physical_model.json"
DEFAULT_RESET_MODEL_PATH = repo_root + r"\server\robot_control\shared_geometry\physical_model - Copy.json"

added_reset_input = ensure_reset_input()
model_file = optional_input("model_path", DEFAULT_MODEL_PATH)
reset_file = DEFAULT_RESET_MODEL_PATH
if optional_bool("reset"):
    if not os.path.exists(reset_file):
        raise FileNotFoundError("reset model copy not found: {0}".format(reset_file))
    with open(reset_file, "r", encoding="utf-8") as handle:
        json.load(handle)
    shutil.copyfile(reset_file, model_file)
    print("Reset {0} from {1}".format(model_file, reset_file))

if not os.path.exists(model_file):
    raise FileNotFoundError("common_model.json not found: {0}".format(model_file))

with open(model_file, "r", encoding="utf-8") as handle:
    model = json.load(handle)

default_section = (((model.get("defaults") or {}).get("solid") or {}).get("section") or {})
breps = []
labels = []
for body in model.get("bodies", []):
    brep = beam_to_brep(body, default_section)
    if brep:
        breps.append(brep)
        labels.append("{0} ({1}): {2}".format(body.get("id"), body.get("family"), body.get("label")))

geometry = breps
a = breps
if added_reset_input:
    print("Added reset input. Wire a Button to it, then press reset to reload the copy JSON.")
print("Loaded {0} beam Breps from {1}".format(len(breps), model_file))
print("Model: {0}".format(model.get("name", "unnamed")))
# ---------- end py3 ----------

# ----
series = Series(Start=0, Step=1, Count="9")
rotate = Rotate(Geometry=hologram_model.geometry, Angle="pi/2", Plane=PlaneXY(0, 0, 0))  # -> Geometry, Transform
concatenate = Concatenate(FragmentA="dynamic_", FragmentB=series)
concatenate_2 = Concatenate(FragmentA="dynamic_snappy-V110B110_box", FragmentB=series)

rotate_2 = Rotate(Geometry=py3.geometry, Angle="pi/2", Plane=PlaneXY(0, 0, 0))  # -> Geometry, Transform

# ---- group: just to give it a bit of differentiation
repeat_data = RepeatData(
    Data=[ColourSwatch(SwatchColor=RGB(148, 185, 255)), ColourSwatch(SwatchColor=RGB(196, 255, 176)), ColourSwatch(SwatchColor=RGB(255, 176, 176))],
    Length="9")

# ---- group: digital
brep_6 = Brep(rotate.Geometry)

# ---- group: physical
brep_7 = Brep(rotate_2.Geometry)

# ---- group: pivot
point = Point(<point referenced from the Rhino model>)

# ---- group: pivot point
point_2 = Point(<point referenced from the Rhino model>)

# ----
panel_2 = Panel("""0
-45
-90
-45
0""")
range_3 = Range(Domain="1 to 3", Steps="4")

# ---- group: timing control
range_4 = Range(Domain="1 to 3", Steps="4")
merge = Merge(Data1=flatten(range_4), Data2=flatten("10"))

# ----
# Motion: WAVE
panel_3 = Panel("waveL")

# ---- group: show/hide robot
value_list = ValueList({"Show Robot": "HOLO1_robot_on", "Hide Robot": "HOLO1_robot_off"}, selected="Hide Robot")
publish_topic = PublishTopic(
    WSC=wsconnection.WebsocketObject,
    TopicName="WorkerPool/control",
    Message=value_list,
    Publish=Button(),
    MessageType="std_msgs/String")

# ---- group: reset robot
publish_topic_2 = PublishTopic(
    WSC=wsconnection.WebsocketObject,
    TopicName="/Robot/reset",
    Message="UR10",
    Publish=Button(),
    MessageType="std_msgs/String")

# ----
# TYPE
embodiment_type = ValueList({"in_robot": 0, "standalone": 1}, selected="in_robot")

brep_8 = Brep(<brep referenced from the Rhino model>)
brep_9 = Brep(<brep referenced from the Rhino model>)
stream_filter = StreamFilter(Gate=embodiment_type, Stream0=brep_9, Stream1=brep_8)
stream_filter_2 = StreamFilter(
    Gate=embodiment_type,
    Stream0=ColourSwatch(SwatchColor=RGB(212, 212, 212)),
    Stream1=ColourSwatch(SwatchColor=RGB(0, 0, 0)))

stream_filter_3 = StreamFilter(Gate=embodiment_type, Stream0=animation_keyframe, Stream1=animation_keyframe_2)

brep_10 = Brep(<brep referenced from the Rhino model>)
brep_11 = Brep(<brep referenced from the Rhino model>)
stream_filter_4 = StreamFilter(Gate=embodiment_type, Stream0=brep_10, Stream1=brep_11)
yz_plane = YZPlane(Origin=Point(0, 0, 0))
stream_filter_5 = StreamFilter(
    Gate=embodiment_type,
    Stream0=ColourSwatch(SwatchColor=RGBA(212, 70, 70, 238)),
    Stream1=ColourSwatch(SwatchColor=RGBA(48, 79, 255, 222)))

stream_filter_6 = StreamFilter(
    Gate=embodiment_type,
    Stream0=ColourSwatch(SwatchColor=RGBA(48, 48, 48, 222)),
    Stream1=ColourSwatch(SwatchColor=RGBA(0, 102, 255, 222)))

# ---- group: arms / ears
brep_12 = Brep(<brep referenced from the Rhino model>)
brep_13 = Brep(<brep referenced from the Rhino model>)
stream_filter_7 = StreamFilter(Gate=embodiment_type, Stream0=brep_13, Stream1=brep_12)

# ----
stream_filter_8 = StreamFilter(Gate=embodiment_type, Stream0="eye", Stream1="glowy_eye")

# ---- group: eye
brep_14 = Brep(stream_filter_4)

# ----
mirror = Mirror(Geometry=point_2, Plane=yz_plane)  # -> Geometry, Transform
xy_plane_3 = XYPlane(Origin=point_2)
xz_plane = XZPlane(Origin=point_2)
xz_plane_2 = XZPlane(Origin=mirror.Geometry)
xy_plane_4 = XYPlane(Origin=mirror.Geometry)
stream_filter_9 = StreamFilter(Gate=embodiment_type, Stream0=xy_plane_3, Stream1=xz_plane)
stream_filter_10 = StreamFilter(Gate=embodiment_type, Stream0=xy_plane_4, Stream1=xz_plane_2)
xy_plane_5 = XYPlane(Origin=mirror.Geometry)
xy_plane_6 = XYPlane(Origin=point_2)
rotate_3 = Rotate(Geometry=xy_plane_6, Angle=degrees(panel_2), Plane=stream_filter_9)  # -> Geometry, Transform
rotate_4 = Rotate(Geometry=xy_plane_5, Angle=expr("-x", degrees(panel_2)), Plane=stream_filter_10)  # -> Geometry, Transform
animation_keyframe_3 = AnimationKeyframe(Time=range_3, Pose=rotate_3.Geometry, Scale=Vector(1, 1, 1))
animation_keyframe_4 = AnimationKeyframe(Time=range_3, Pose=rotate_4.Geometry, Scale=Vector(1, 1, 1))

panel_4 = Panel("""1
0.05
0.8
0.05
1
1""")
vector_xyz_2 = VectorXYZ(XComponent="1", YComponent="1", ZComponent=panel_4)  # -> Vector, Length
vector_xyz_3 = VectorXYZ(XComponent="1", YComponent=panel_4, ZComponent="1")  # -> Vector, Length
stream_filter_11 = StreamFilter(Gate=embodiment_type, Stream0=vector_xyz_3.Vector, Stream1=vector_xyz_2.Vector)
xy_plane_7 = XYPlane(Origin=point)
list_length = ListLength(List=merge)
repeat_data_2 = RepeatData(Data=xy_plane_7, Length=list_length)
animation_keyframe_5 = AnimationKeyframe(Time=merge, Pose=repeat_data_2, Scale=stream_filter_11)

# ----
# PREVIEW
trigger = Trigger(Interval=100, TimerInterval=100, Target=python_3_script)  # disabled
python_3_script = Python3Script(reset=Button(), interval="0.1")  # -> out, t; inputs interval: Double
# ---------- python_3_script: Python ----------
"""Grasshopper Script"""

from rhinoscriptsyntax import scriptcontext as sc


if reset:
    sc.sticky["time"] = None
else:
    if sc.sticky["time"] is not None:
        sc.sticky["time"] += interval
        if sc.sticky["time"] >= 60: # reset after 1 min (arbitrary number)
            sc.sticky["time"] = None
    else:
        sc.sticky["time"] = 0

t = sc.sticky["time"]
print(t)
# ---------- end python_3_script ----------
panel_5 = Panel(Slider(1, range=1..4))

# ----
# Manual triggers for animations on the headset
value_list_2 = ValueList({"start_wave", "stop_wave"}, selected="start_wave")
value_list_3 = ValueList({"start_move", "stop_move"}, selected="start_move")
value_list_4 = ValueList({"start_blink", "stop_blink"}, selected="start_blink")
data = Data(wsconnection.WebsocketObject)
concatenate_3 = Concatenate(FragmentA=value_list_2, FragmentB=["L", "R"])
publish_topic_3 = PublishTopic(WSC=data, TopicName="HOLO1_AnimSignal", Message=concatenate_3, Publish=Button(), MessageType="std_msgs/String")
publish_topic_4 = PublishTopic(WSC=data, TopicName="HOLO1_AnimSignal", Message=value_list_4, Publish=Button(), MessageType="std_msgs/String")
publish_topic_5 = PublishTopic(WSC=data, TopicName="HOLO1_AnimSignal", Message=value_list_3, Publish=Button(), MessageType="std_msgs/String")

# ----
# ROBOT KINEMATICS
# [unit: mm]
mesh_2 = Mesh(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)
stream_filter_12 = StreamFilter(Gate=open_gripper, Stream0=mesh, Stream1=mesh_2)
xy_plane_8 = XYPlane(Origin=Point(0, 0, 0))

rotate_5 = Rotate(Geometry=stream_filter_12, Angle=1.570796327, Plane=PlaneXY(0, 0, 0))  # -> Geometry, Transform

define_end_effector = DefineEndEffector(Geometry=rotate_5.Geometry, TCPFrame=move.Geometry, MountingFrame=PlaneXY(0, 0, 0))
predefined_universal_robot_ur10 = PredefinedUniversalRobotUR10(BaseFrame=xy_plane_8, EndEffectorOptional=define_end_effector)

# ----
# Define Robot
links = Panel("""new_ur10_nogripper
base_link
base_link_inertia
shoulder_link
upper_arm_link
forearm_link
wrist_1_link
wrist_2_link
wrist_3_link
flange""")
robot = Robot(
    WebsocketObject=wsconnection.WebsocketObject,
    Disable=False,
    RobotName="UR10",
    VirtualRobotModelNS=predefined_universal_robot_ur10,
    AxisToggles=[False, False, True],
    JointNames=links)  # -> Output, RobotObject

# ----
# Content: ROBOT BODY
colour_swatch = ColourSwatch(SwatchColor=RGB(209, 209, 209))
panel_6 = Panel("""3
4
5
6
7""")
cluster = Cluster_2(geometry=brep, geometry_2=brep_2, geometry_3=brep_4, geometry_4=brep_3, geometry_5=brep_5)
concatenate_4 = Concatenate(FragmentA="touchy_limb", FragmentB=panel_6)
list_item = ListItem(List=links, Index=panel_6, Wrap=True)
data_2 = Data(robot.RobotObject)
display_rule = DisplayRule(TargetAnchor=data_2, LinkName=list_item, anchorType="link")
scene_mesh_object = SceneMeshObject(TargetAnchor=data_2, Meshes=cluster, Names=concatenate_4, Colours=colour_swatch, DisplayRules=display_rule)  # -> Output, MeshGeometryObjects
stream_filter_13 = StreamFilter(Gate=embodiment_type, Stream0=scene_mesh_object.MeshGeometryObjects)
construct_scene_content = ConstructSceneContent(Name="body", Meshes=stream_filter_13, LevelOfDetail=0)
stream_filter_14 = StreamFilter(Gate=embodiment_type, Stream0=construct_scene_content)

# ----
# Content Anchors
display_rule_2 = DisplayRule(TargetAnchor=tracked_object.TrackedDevice, anchorType="session")
display_rule_3 = DisplayRule(TargetAnchor=robot.RobotObject, anchorType="flange")
stream_filter_15 = StreamFilter(Gate=embodiment_type, Stream0=display_rule_3, Stream1=display_rule_2)
stream_filter_16 = StreamFilter(Gate=embodiment_type, Stream0=robot.RobotObject, Stream1=tracked_object.TrackedDevice)

# ---- group: robot
data_3 = Data(robot.RobotObject)

# ---- group: AR anchor [target]
data_4 = Data(stream_filter_16)

# ---- group: rule
data_5 = Data(stream_filter_15)

# ----
# Content: HEAD
scene_mesh_object_2 = SceneMeshObject(TargetAnchor=data_4, Meshes=stream_filter, Names="head", Colours=stream_filter_2, DisplayRules=data_5)  # -> Output, MeshGeometryObjects
construct_scene_content_2 = ConstructSceneContent(Name="head", Meshes=scene_mesh_object_2.MeshGeometryObjects, LevelOfDetail=0)

# ---- group: anim anchor [content]
data_6 = Data(construct_scene_content_2)

# ----
# Content: EAR/ARM
brep_15 = Brep(stream_filter_7)
mirror_2 = Mirror(Geometry=brep_15, Plane=yz_plane)  # -> Geometry, Transform
scene_mesh_object_3 = SceneMeshObject(TargetAnchor=data_4, Meshes=brep_15, Names="lefty", Colours=stream_filter_6, DisplayRules=data_5)  # -> Output, MeshGeometryObjects
scene_mesh_object_4 = SceneMeshObject(TargetAnchor=data_4, Meshes=mirror_2.Geometry, Names="righty", Colours=stream_filter_6, DisplayRules=data_5)  # -> Output, MeshGeometryObjects
construct_scene_content_3 = ConstructSceneContent(Name="lefty", Meshes=scene_mesh_object_3.MeshGeometryObjects, LevelOfDetail=0)
construct_scene_content_4 = ConstructSceneContent(Name="righty", Meshes=scene_mesh_object_4.MeshGeometryObjects, LevelOfDetail=0)

# ----
# Content: EYE
panel_7 = Panel(stream_filter_8)
scene_mesh_object_5 = SceneMeshObject(TargetAnchor=data_4, Meshes=brep_14, Names=panel_7, Colours=stream_filter_5, DisplayRules=data_5)  # -> Output, MeshGeometryObjects
# Motion: BLINK
construct_scene_content_5 = ConstructSceneContent(Name=panel_7, Meshes=scene_mesh_object_5.MeshGeometryObjects, LevelOfDetail=0)

construct_animation = ConstructAnimation(
    Name=panel_3,
    Content=construct_scene_content_3,
    Keyframes=animation_keyframe_3,
    Anchor=data_6,
    PreviewTime=panel_5,
    Pivot=point_2,
    Easing="linear",
    LoopMode="loop",
    ShowAdvancedInputs=False)
construct_animation_2 = ConstructAnimation(
    Name="waveR",
    Content=construct_scene_content_4,
    Keyframes=animation_keyframe_4,
    Anchor=data_6,
    PreviewTime=panel_5,
    Pivot=mirror.Geometry,
    Easing="linear",
    LoopMode="loop",
    ShowAdvancedInputs=False)
construct_animation_3 = ConstructAnimation(
    Name="blink",
    Content=construct_scene_content_5,
    Keyframes=animation_keyframe_5,
    Anchor=data_6,
    PreviewTime=panel_5,
    Pivot=point,
    Easing="linear",
    LoopMode="once",
    ShowAdvancedInputs=False)
relay = Relay([construct_animation_2, construct_animation])

# ---- group: run robot trajectory
cluster_2 = Cluster_3(data=robot.RobotObject, start=Button(), plane=construct_point, robot=predefined_universal_robot_ur10)
# Useful Controls
geometry = Geometry(cluster_2)

# ----
display_rule_4 = DisplayRule(TargetAnchor=data_3, anchorType="session")
cluster_3 = Cluster(relay=data_3, geometry=rotate_5.Geometry)
construct_scene_content_6 = ConstructSceneContent(Name="ee-gripper", Meshes=flatten(cluster_3), LevelOfDetail=0)

# ---- group: AR display
scene_mesh_object_6 = SceneMeshObject(TargetAnchor=data_3, Meshes=brep_6, Names=concatenate_2, Colours=repeat_data, DisplayRules=display_rule_4)  # -> Output, MeshGeometryObjects

# ---- group: moveit model
scene_mesh_object_7 = SceneMeshObject(TargetAnchor=data_3, Meshes=brep_7, Names=concatenate, Colours=repeat_data, DisplayRules=display_rule_4)  # -> Output, MeshGeometryObjects

# ----
construct_scene_content_7 = ConstructSceneContent(Name="cool beams", Meshes=scene_mesh_object_6.MeshGeometryObjects, LevelOfDetail=0)

stream_filter_17 = StreamFilter(Gate=embodiment_type, Stream0=construct_scene_content_6, Stream1=hololens.ARDevice)

# ----
# moveit scene
button_3 = Button()
planning_scene_model = PlanningSceneModel(
    Robot=robot.RobotObject,
    SceneGeometries=scene_mesh_object_7.MeshGeometryObjects,
    TriggerSend=button_3,
    TriggerRemove=Button())
panel_8 = Panel(planning_scene_model)

construct_animation_4 = ConstructAnimation(
    Name="move",
    Content=construct_scene_content_2,
    Keyframes=stream_filter_3,
    Anchor=stream_filter_17,
    PreviewTime=panel_5,
    Pivot=construct_point_2,
    Easing="linear",
    LoopMode="once",
    ShowAdvancedInputs=False)

# ----
# AR scene
button_4 = Button()
data_7 = Data(hololens.ARDevice)
modeltracker = ModelTracker(Online=toggle, ARDevice=data_7, Meshes=brep_6, Names=concatenate_2)  # -> Status, Names, DebugTransformsX, DebugTransformsT, TransformedMesh
xr_scene_model = XRSceneModel(
    GHControl=True,
    ARDevices=data_7,
    ContentObjects=[construct_scene_content_6, construct_scene_content_7],
    TriggerSend=button_4,
    TriggerRemove=Button(),
    TimeDelay=100)
py3_2 = Python3Script(
    orient=modeltracker.DebugTransformsX,
    transl=modeltracker.DebugTransformsT,
    names=concatenate_2,
    tracked_meshes=modeltracker.TransformedMesh)  # -> out, a; inputs orient: list, transl: list, names: list of String, tracked_meshes: list of Mesh
# ---------- py3_2: Python ----------
#! python 3
"""Forward ModelTracker events to the external hologram sync service.

Connect:
  orient -> ModelTracker DebugTransforms X
  transl -> ModelTracker DebugTransforms T
  names -> dynamic_snappy-V44B80_box0..8
  tracked_meshes -> ModelTracker Transformed Mesh

Run the service from the repo server directory:
  uv run python -m robot_control.shared_geometry.modeltracker_sync_server
"""

import json
import urllib.error
import urllib.request

SYNC_URL = "http://127.0.0.1:8788/modeltracker-event"
TIMEOUT_SECONDS = 2.0


def as_list(value):
    if value is None:
        return []
    if isinstance(value, (list, tuple)):
        return list(value)
    try:
        return list(value)
    except TypeError:
        return [value]


def transform_cell(xform, row, col):
    try:
        return float(xform[row, col])
    except Exception:
        attr = "M{0}{1}".format(row, col)
        if hasattr(xform, attr):
            return float(getattr(xform, attr))
    raise ValueError("input is not a Rhino transform")


def transform_matrix(xform):
    return [[transform_cell(xform, row, col) for col in range(4)] for row in range(4)]


def mesh_center(mesh):
    if mesh is None:
        raise ValueError("tracked mesh is missing")
    if hasattr(mesh, "GetBoundingBox"):
        bbox = mesh.GetBoundingBox(True)
        if hasattr(bbox, "IsValid") and not bbox.IsValid:
            raise ValueError("tracked mesh bounding box is invalid")
        center = bbox.Center
        return [float(center.X), float(center.Y), float(center.Z)]
    if hasattr(mesh, "Vertices"):
        points = [[float(v.X), float(v.Y), float(v.Z)] for v in mesh.Vertices]
        if not points:
            raise ValueError("tracked mesh has no vertices")
        mins = [min(point[index] for point in points) for index in range(3)]
        maxs = [max(point[index] for point in points) for index in range(3)]
        return [(mins[index] + maxs[index]) / 2.0 for index in range(3)]
    raise ValueError("tracked input does not expose mesh geometry")


def post_event(payload):
    body = json.dumps(payload, separators=(",", ":")).encode("utf-8")
    request = urllib.request.Request(
        SYNC_URL,
        data=body,
        headers={"Content-Type": "application/json"},
        method="POST",
    )
    with urllib.request.urlopen(request, timeout=TIMEOUT_SECONDS) as response:
        text = response.read().decode("utf-8")
    return json.loads(text)


status_lines = []
try:
    orient_list = as_list(orient)
    transl_list = as_list(transl)
    name_list = [str(name) for name in as_list(names)]
    mesh_list = as_list(tracked_meshes)

    if not orient_list or not transl_list or not name_list or not mesh_list:
        status_lines.append("Waiting for orient/transl/names/tracked_meshes inputs.")
    else:
        payload = {
            "source": "grasshopper_model_listener",
            "names": name_list,
            "orient": [transform_matrix(xform) for xform in orient_list],
            "transl": [transform_matrix(xform) for xform in transl_list],
            "mesh_centers": [mesh_center(mesh) for mesh in mesh_list],
        }
        result = post_event(payload)
        if result.get("ok") and result.get("updated"):
            pose = result.get("pose") or {}
            xyz = pose.get("xyz") or [None, None, None]
            status_lines.append(
                "{0}: external sync updated index {1}; xyz=({2:.4f}, {3:.4f}, {4:.4f})".format(
                    result.get("object_name"),
                    result.get("event_index"),
                    float(xyz[0]),
                    float(xyz[1]),
                    float(xyz[2]),
                )
            )
        elif result.get("ok"):
            status_lines.append(str(result.get("status") or "External sync made no write."))
        else:
            status_lines.append("No write: {0}".format(result.get("error")))
except urllib.error.URLError as exc:
    status_lines.append("No write: external sync service unavailable at {0}: {1}".format(SYNC_URL, exc))
except Exception as exc:
    status_lines.append("No write: {0}".format(exc))

a = "\n".join(status_lines)
print(a)
# ---------- end py3_2 ----------

# ----
# PUSH TO HEADSET
remove = Button()
remove_2 = Button()
send = Button()
send_2 = Button()
data_8 = Data([construct_scene_content_2, construct_scene_content_5, construct_scene_content_4, construct_scene_content_3, stream_filter_14])
xr_animation_model = XRAnimationModel(
    ARDevices=hololens.ARDevice,
    Animations=[construct_animation_4, construct_animation_3, relay],
    TriggerCreate=send_2,
    TriggerDestroy=remove_2,
    TriggerDestroyAll=False,
    TimeDelay=100)
xr_scene_model_2 = XRSceneModel(
    GHControl=True,
    ARDevices=hololens.ARDevice,
    ContentObjects=flatten(data_8),
    TriggerSend=send,
    TriggerRemove=remove,
    TimeDelay=100)

# ==== cluster Cluster
geometry = ClusterInput()
relay = ClusterInput()
scale = Scale(Geometry=geometry, Center=Point(0, 0, 0), Factor=0.001)  # -> Geometry, Transform
yz_plane = YZPlane(Origin=Point(0, 0, 0))
rotate = Rotate(Geometry=scale.Geometry, Angle=-1.570796327, Plane=yz_plane)  # -> Geometry, Transform
display_rule = DisplayRule(TargetAnchor=relay, anchorType="flange")
scene_mesh_object = SceneMeshObject(
    TargetAnchor=relay,
    Meshes=rotate.Geometry,
    Names="mesh",
    Colours=ColourSwatch(SwatchColor=RGB(222, 222, 222)),
    DisplayRules=display_rule)  # -> Output, MeshGeometryObjects
mesh_geometry_objects = ClusterOutput(scene_mesh_object.MeshGeometryObjects)

# ==== cluster Cluster_2
xy_plane = XYPlane(Origin=Point(-6.72202241e-09, -9.089303082e-09, 0.03799999878))
xz_plane = XZPlane(Origin=Point(7.979536754e-05, -0.0860002099, 0.1283187642))
xz_plane_2 = XZPlane(Origin=Point(-0.0006015452933, -0.1078906953, 0.7400984807))
xz_plane_3 = XZPlane(Origin=Point(-0.5715999975, -0.1036998978, 0.7406999882))
xy_plane_2 = XYPlane(Origin=Point(-0.5715983821, -0.163890998, 0.681616333))
rotate = Rotate(Geometry=xz_plane, Angle=3.141592654, Plane=xz_plane)  # -> Geometry, Transform
flip_plane = FlipPlane(Plane=xy_plane_2, ReverseX=Toggle(True), ReverseY=False, SwapAxes=True)
flip_plane_2 = FlipPlane(Plane=xz_plane_2, ReverseX=False, ReverseY=False, SwapAxes=True)
geometry = ClusterInput()
geometry_2 = ClusterInput()
geometry_3 = ClusterInput()
geometry_4 = ClusterInput()
geometry_5 = ClusterInput()
orient = Orient(Geometry=geometry, Source=xy_plane, Target=PlaneXY(0, 0, 0))  # -> Geometry, Transform
orient_2 = Orient(Geometry=geometry_2, Source=rotate.Geometry, Target=PlaneXY(0, 0, 0))  # -> Geometry, Transform
orient_3 = Orient(Geometry=geometry_3, Source=flip_plane_2, Target=PlaneXY(0, 0, 0))  # -> Geometry, Transform
orient_4 = Orient(Geometry=geometry_4, Source=xz_plane_3, Target=PlaneXY(0, 0, 0))  # -> Geometry, Transform
orient_5 = Orient(Geometry=geometry_5, Source=flip_plane, Target=PlaneXY(0, 0, 0))  # -> Geometry, Transform
solid_union = SolidUnion(Breps=orient_2.Geometry)
solid_union_2 = SolidUnion(Breps=orient_3.Geometry)
entwine = Entwine(
    Branch00=orient.Geometry,
    Branch01=solid_union,
    Branch02=solid_union_2,
    Branch03=orient_4.Geometry,
    Branch04=orient_5.Geometry,
    FlattenInputs=True)  # -> flatten(Result)
result = ClusterOutput(entwine)

# ==== cluster Cluster_3
data = ClusterInput()
plane = ClusterInput()
data_2 = Data([Plane(origin=(266.0314979, 781.7036699, 150), x=(0, 1, 0), y=(1, 0, 0)), Plane(origin=(853.9437085, 751.746387, 150), x=(0, 1, 0), y=(1, 0, 0)), Plane(origin=(910.1139162, 691.8318213, 150), x=(0, 1, 0), y=(1, 0, 0)), Plane(origin=(955.0499335, 620.6830653, 150), x=(0, 1, 0), y=(1, 0, 0)), Plane(origin=(958.7942914, 553.2792254, 150), x=(0, 1, 0), y=(1, 0, 0)), Plane(origin=(958.7942914, 497.1092038, 150), x=(0, 1, 0), y=(1, 0, 0))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])

# ---- group: robot
data_3 = Data(data)

# ----
plane_2 = Plane(plane)
scale = Scale(Geometry=data_2, Center=Point(0, 0, 0), Factor=".001")  # -> Geometry, Transform
flip_plane = FlipPlane(Plane=plane_2, ReverseX=False, ReverseY=False, SwapAxes=True)
robot_trajectory_object = RobotTrajectoryObject(TargetRobot=data_3, ParamSpace=True, TCPFrames=scale.Geometry, TrajectoryWidth=0.01)  # -> Output, TrajectoryObject, TrajectoryMesh
merge = Merge(Data1=Toggle(False), Data2=Toggle(False), Data3=Toggle(True))
robot = ClusterInput()
robot_inverse_kinematics = RobotInverseKinematics(Robot=robot, TargetTCPFrame=flip_plane, AxisToggles=merge, useColorPreview=True)  # -> PoseGeometry, AxisValues, AxisFrames
construct_task_object = ConstructTaskObject(
    TaskNames="hello",
    TargetDevices=data_3,
    RobotTrajectory=robot_trajectory_object.TrajectoryObject,
    AssociatedSkill="null",
    EstimatedDuration=60)  # -> Output, TaskObject
start = ClusterInput()
robotsimulator = RobotSimulator(Robot=data_3, RobotTask=construct_task_object.TaskObject, StepInterval=1000, Start=start)  # -> Output, CurrentTCP, CurrentGeometry, ExternalAxis
scale_2 = Scale(Geometry=robot_inverse_kinematics.PoseGeometry, Center=Point(0, 0, 0), Factor=0.001)  # -> Geometry, Transform
geometry = ClusterOutput(scale_2.Geometry)
