# Grasshopper definition Act_scene.gh (Grasshopper 1.0.8)
# plug-ins: Virtual Robot, Cassis, Vizor

button = Button()

md_slider = MDSlider(
    SliderMode=0,
    slider_value=Point(0.269776228, 0.7817036699, 0.5),
    x_domain=Domain(0, 1),
    y_domain=Domain(0, 1),
    z_domain=Domain(0, 1))
open_gripper = BooleanToggle(False)

deconstruct = Deconstruct(Point=expr("x*1000", md_slider))  # -> XComponent, YComponent, ZComponent
construct_point = ConstructPoint(XCoordinate=deconstruct.XComponent, YCoordinate=deconstruct.YComponent, ZCoordinate=Slider(150, range=0..1000))

cassis = Cassis(
    Prefix="http://localhost:3003/mcp/",
    EnabledTools="Remove_Script_Parameter,Modify_Script_Component_Parameters,Add_Script_Parameter,List_Python_Scripts,Get_Python_Script,Edit_Python_Script,Get_Python_Script_Errors,Edit_Script,Set_Component_Value,Get_Component_Output,GetAllConnections,ForceDocumentSolution,RecomputeScriptComponents,Get_Components_In_Group,Get_Parameter_TypeHints,GetDetailedComponentInfo")

# ---- group: physical_model
py3 = Python3Script(refresh=Button(), reset=Button())  # -> out, geometry; inputs refresh: Boolean
# ---------- py3: Python ----------
#! python 3

"""Load physical_model.json and emit Rhino Brep boxes for Grasshopper preview."""
import json
import os
import shutil

import Rhino.Geometry as rg
import System


def ensure_reset_input():
    component = ghenv.Component
    for param in component.Params.Input:
        if param.Name == "reset" or param.NickName == "reset":
            param.Name = "reset"
            param.NickName = "reset"
            param.Optional = True
            return False
    if component.Params.Input.Count == 0:
        raise RuntimeError("Cannot add reset input without a script input template")
    template = component.Params.Input[0]
    param = System.Activator.CreateInstance(template.GetType())
    param.Name = "reset"
    param.NickName = "reset"
    param.Optional = True
    param.Description = "Wire a Button here to reload physical_model.json from physical_model - Copy.json."
    component.Params.RegisterInputParam(param, component.Params.Input.Count)
    component.Params.OnParametersChanged()
    component.ExpireSolution(True)
    return True


def optional_input(name, fallback=None):
    value = globals().get(name, fallback)
    if value is None:
        return fallback
    text = str(value).strip()
    return text if text else fallback


def optional_bool(name, fallback=False):
    value = globals().get(name, fallback)
    if value is None:
        return fallback
    if isinstance(value, bool):
        return value
    text = str(value).strip().lower()
    if not text:
        return fallback
    return text in ("1", "true", "yes", "on")


def point3(values):
    return rg.Point3d(float(values[0]), float(values[1]), float(values[2]))


def unitized(vector, fallback):
    v = rg.Vector3d(vector)
    if v.Length <= 1e-9:
        v = rg.Vector3d(fallback)
    v.Unitize()
    return v


def stable_beam_plane(start, end):
    axis = end - start
    length = axis.Length
    if length <= 1e-9:
        raise ValueError("Beam axis has zero length")

    x_axis = unitized(axis, rg.Vector3d.XAxis)
    up = rg.Vector3d.ZAxis
    ref = rg.Vector3d.YAxis if abs(rg.Vector3d.Multiply(x_axis, up)) > 0.95 else up
    y_axis = rg.Vector3d.CrossProduct(ref, x_axis)
    y_axis = unitized(y_axis, rg.Vector3d.YAxis)

    center = rg.Point3d(
        (start.X + end.X) * 0.5,
        (start.Y + end.Y) * 0.5,
        (start.Z + end.Z) * 0.5,
    )
    return rg.Plane(center, x_axis, y_axis), length


def beam_to_brep(body, default_section):
    axis = body.get("axis") or {}
    start = point3(axis["start_xyz"])
    end = point3(axis["end_xyz"])
    plane, length = stable_beam_plane(start, end)

    dimensions = ((body.get("solid") or {}).get("dimensions") or {})
    section_y = float(dimensions.get("y", default_section.get("y", 0.04)))
    section_z = float(dimensions.get("z", default_section.get("z", 0.04)))

    box = rg.Box(
        plane,
        rg.Interval(-length * 0.5, length * 0.5),
        rg.Interval(-section_y * 0.5, section_y * 0.5),
        rg.Interval(-section_z * 0.5, section_z * 0.5),
    )
    brep = box.ToBrep()
    if brep:
        brep.UserDictionary.Set("common_model_id", body.get("id", ""))
        brep.UserDictionary.Set("common_model_family", body.get("family", ""))
        brep.UserDictionary.Set("common_model_label", body.get("label", ""))
    return brep


gh_path = ghenv.Component.OnPingDocument().FilePath.replace("/", "\\")
gh_dir = gh_path.rsplit("\\", 1)[0]
repo_root = gh_dir.rsplit("\\examples", 1)[0]
DEFAULT_MODEL_PATH = repo_root + r"\server\robot_control\shared_geometry\physical_model.json"
DEFAULT_RESET_MODEL_PATH = repo_root + r"\server\robot_control\shared_geometry\physical_model - Copy.json"

added_reset_input = ensure_reset_input()
model_file = optional_input("model_path", DEFAULT_MODEL_PATH)
reset_file = DEFAULT_RESET_MODEL_PATH
if optional_bool("reset"):
    if not os.path.exists(reset_file):
        raise FileNotFoundError("reset model copy not found: {0}".format(reset_file))
    with open(reset_file, "r", encoding="utf-8") as handle:
        json.load(handle)
    shutil.copyfile(reset_file, model_file)
    print("Reset {0} from {1}".format(model_file, reset_file))

if not os.path.exists(model_file):
    raise FileNotFoundError("common_model.json not found: {0}".format(model_file))

with open(model_file, "r", encoding="utf-8") as handle:
    model = json.load(handle)

default_section = (((model.get("defaults") or {}).get("solid") or {}).get("section") or {})
breps = []
labels = []
for body in model.get("bodies", []):
    brep = beam_to_brep(body, default_section)
    if brep:
        breps.append(brep)
        labels.append("{0} ({1}): {2}".format(body.get("id"), body.get("family"), body.get("label")))

geometry = breps
a = breps
if added_reset_input:
    print("Added reset input. Wire a Button to it, then press reset to reload the copy JSON.")
print("Loaded {0} beam Breps from {1}".format(len(breps), model_file))
print("Model: {0}".format(model.get("name", "unnamed")))
# ---------- end py3 ----------

# ----
hologram_model = Python3Script(refresh=button, reset=Button())  # -> out, geometry; inputs refresh: Boolean
# ---------- hologram_model: Python ----------
#! python 3

"""Load hologram_model.json and emit Rhino Brep boxes for Grasshopper preview."""
import json
import os
import shutil

import Rhino.Geometry as rg
import System


def ensure_reset_input():
    component = ghenv.Component
    for param in component.Params.Input:
        if param.Name == "reset" or param.NickName == "reset":
            param.Name = "reset"
            param.NickName = "reset"
            param.Optional = True
            return False
    if component.Params.Input.Count == 0:
        raise RuntimeError("Cannot add reset input without a script input template")
    template = component.Params.Input[0]
    param = System.Activator.CreateInstance(template.GetType())
    param.Name = "reset"
    param.NickName = "reset"
    param.Optional = True
    param.Description = "Wire a Button here to reload hologram_model.json from hologram_model - Copy.json."
    component.Params.RegisterInputParam(param, component.Params.Input.Count)
    component.Params.OnParametersChanged()
    component.ExpireSolution(True)
    return True


def optional_input(name, fallback=None):
    value = globals().get(name, fallback)
    if value is None:
        return fallback
    text = str(value).strip()
    return text if text else fallback


def optional_bool(name, fallback=False):
    value = globals().get(name, fallback)
    if value is None:
        return fallback
    if isinstance(value, bool):
        return value
    text = str(value).strip().lower()
    if not text:
        return fallback
    return text in ("1", "true", "yes", "on")


def point3(values):
    return rg.Point3d(float(values[0]), float(values[1]), float(values[2]))


def unitized(vector, fallback):
    v = rg.Vector3d(vector)
    if v.Length <= 1e-9:
        v = rg.Vector3d(fallback)
    v.Unitize()
    return v


def stable_beam_plane(start, end):
    axis = end - start
    length = axis.Length
    if length <= 1e-9:
        raise ValueError("Beam axis has zero length")

    x_axis = unitized(axis, rg.Vector3d.XAxis)
    up = rg.Vector3d.ZAxis
    ref = rg.Vector3d.YAxis if abs(rg.Vector3d.Multiply(x_axis, up)) > 0.95 else up
    y_axis = rg.Vector3d.CrossProduct(ref, x_axis)
    y_axis = unitized(y_axis, rg.Vector3d.YAxis)

    center = rg.Point3d(
        (start.X + end.X) * 0.5,
        (start.Y + end.Y) * 0.5,
        (start.Z + end.Z) * 0.5,
    )
    return rg.Plane(center, x_axis, y_axis), length


def beam_to_brep(body, default_section):
    axis = body.get("axis") or {}
    start = point3(axis["start_xyz"])
    end = point3(axis["end_xyz"])
    plane, length = stable_beam_plane(start, end)

    dimensions = ((body.get("solid") or {}).get("dimensions") or {})
    section_y = float(dimensions.get("y", default_section.get("y", 0.04)))
    section_z = float(dimensions.get("z", default_section.get("z", 0.04)))

    box = rg.Box(
        plane,
        rg.Interval(-length * 0.5, length * 0.5),
        rg.Interval(-section_y * 0.5, section_y * 0.5),
        rg.Interval(-section_z * 0.5, section_z * 0.5),
    )
    brep = box.ToBrep()
    if brep:
        brep.UserDictionary.Set("common_model_id", body.get("id", ""))
        brep.UserDictionary.Set("common_model_family", body.get("family", ""))
        brep.UserDictionary.Set("common_model_label", body.get("label", ""))
    return brep


gh_path = ghenv.Component.OnPingDocument().FilePath.replace("/", "\\")
gh_dir = gh_path.rsplit("\\", 1)[0]
repo_root = gh_dir.rsplit("\\examples", 1)[0]
DEFAULT_MODEL_PATH = repo_root + r"\server\robot_control\shared_geometry\hologram_model.json"
DEFAULT_RESET_MODEL_PATH = repo_root + r"\server\robot_control\shared_geometry\hologram_model - Copy.json"

added_reset_input = ensure_reset_input()
model_file = optional_input("model_path", DEFAULT_MODEL_PATH)
reset_file = DEFAULT_RESET_MODEL_PATH
if optional_bool("reset"):
    if not os.path.exists(reset_file):
        raise FileNotFoundError("reset model copy not found: {0}".format(reset_file))
    with open(reset_file, "r", encoding="utf-8") as handle:
        json.load(handle)
    shutil.copyfile(reset_file, model_file)
    print("Reset {0} from {1}".format(model_file, reset_file))

if not os.path.exists(model_file):
    raise FileNotFoundError("common_model.json not found: {0}".format(model_file))

with open(model_file, "r", encoding="utf-8") as handle:
    model = json.load(handle)

default_section = (((model.get("defaults") or {}).get("solid") or {}).get("section") or {})
breps = []
labels = []
for body in model.get("bodies", []):
    brep = beam_to_brep(body, default_section)
    if brep:
        breps.append(brep)
        labels.append("{0} ({1}): {2}".format(body.get("id"), body.get("family"), body.get("label")))

geometry = breps
a = breps
if added_reset_input:
    print("Added reset input. Wire a Button to it, then press reset to reload the copy JSON.")
print("Loaded {0} beam Breps from {1}".format(len(breps), model_file))
print("Model: {0}".format(model.get("name", "unnamed")))
# ---------- end hologram_model ----------

xy_plane = XYPlane(Origin=Point(0, 0, 0))
unit_z = UnitZ(Factor="157.5")
move = Move(Geometry=xy_plane, Motion=unit_z)  # -> Geometry, Transform

# ---- group: Open
mesh = Mesh(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)

# ----
mesh_2 = Mesh(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)
stream_filter = StreamFilter(Gate=open_gripper, Stream0=mesh, Stream1=mesh_2)

brep = Brep(hologram_model.geometry)
xy = XYPlane(Origin=Point(0, 0, 0))
Z = UnitZ(Factor=Slider(0.09, range=0..0.1))
planesrf = PlaneSurface(Plane=xy, XSize=Domain(-10, 10), YSize=Domain(-10, 10))
neg = Negative(Value=Z)
move_2 = Move(Geometry=planesrf, Motion=neg)  # -> Geometry, Transform

series = Series(Start=0, Step=1, Count="9")
rotate = Rotate(Geometry=brep, Angle="pi", Plane=PlaneXY(0, 0, 0))  # -> Geometry, Transform
concatenate = Concatenate(FragmentA="dynamic_snappy-V44B80_box", FragmentB=series)

concatenate_2 = Concatenate(FragmentA="dynamic_", FragmentB=series)
Z_2 = UnitZ(Factor="0, 0, 0.09")
neg_2 = Negative(Value=Z_2)
move_3 = Move(Geometry=rotate.Geometry, Motion=neg_2)  # -> Geometry, Transform
brep_2 = Brep(rotate.Geometry)

# ---- group: physical
brep_3 = Brep(py3.geometry)

# ---- group: make sure this is true for listening
toggle = BooleanToggle(True)

# ----
wsconnection = WsConnection(Address="ws://localhost:9090", Reset=Button())  # -> WebsocketObject, ConnectionInfo

# ---- group: Reset UR10
publish_topic = PublishTopic(
    WSC=wsconnection.WebsocketObject,
    TopicName="/Robot/reset",
    MessageType="std_msgs/String",
    Message="UR10",
    Publish=Button())

# ----
hololens = Hololens(
    WebsocketObject=wsconnection.WebsocketObject,
    Disable=False,
    DeviceName="HOLO1",
    SkillConfiguration="{\"monitor\": 1, \"screw\": 1, \"pick\": 1, \"place\": 1}")  # -> Output, ARDevice

# ---- group: model listener
modeltracker = ModelTracker(Online=toggle, ARDevice=hololens.ARDevice, Meshes=rotate.Geometry, Names=concatenate)  # -> Status, Names, DebugTransformsX, DebugTransformsT, TransformedMesh
mesh_3 = Mesh(modeltracker.TransformedMesh)
py3_2 = Python3Script(
    orient=modeltracker.DebugTransformsX,
    transl=modeltracker.DebugTransformsT,
    names=concatenate,
    tracked_meshes=modeltracker.TransformedMesh)  # -> out, a; inputs orient: list, transl: list, names: list of String, tracked_meshes: list of Mesh
# ---------- py3_2: Python ----------
#! python 3
"""Sync one ModelTracker change event into hologram_model.json.

Connect:
  orient -> ModelTracker DebugTransforms X
  transl -> ModelTracker DebugTransforms T
  names -> static dynamic_snappy-V44B80_box0..8 or canonical dynamic_0..8 names
  tracked_meshes -> ModelTracker transformed mesh output

The static names list is matched by index to the ModelTracker debug transform list.
This assumes no hidden offset: box0 -> dynamic_0, box1 -> dynamic_1, and so on.
"""

import json
import math
import os
import re
import tempfile

HOLOGRAM_MODEL_PATH = r"C:\Users\Samuel\Documents\github\pipecat\pipecat-agent\server\robot_control\shared_geometry\hologram_model.json"
DYNAMIC_NAME_RE = re.compile(r"^dynamic_(\d+)$")
SNAPPY_NAME_RE = re.compile(r"^dynamic_snappy-V44B80_box(\d+)$")
EPSILON = 1e-9


def as_list(value):
    if value is None:
        return []
    if isinstance(value, (list, tuple)):
        return list(value)
    try:
        return list(value)
    except TypeError:
        return [value]


def canonical_dynamic_name(value):
    text = str(value).strip()
    snappy_match = SNAPPY_NAME_RE.match(text)
    if snappy_match is not None:
        return "dynamic_{0}".format(int(snappy_match.group(1)))
    dynamic_match = DYNAMIC_NAME_RE.match(text)
    if dynamic_match is not None:
        return "dynamic_{0}".format(int(dynamic_match.group(1)))
    return text


def finite_float(value):
    try:
        number = float(value)
    except Exception:
        return None
    if not math.isfinite(number):
        return None
    return number


def clean_float(value):
    number = finite_float(value)
    if number is None:
        raise ValueError("non-finite number")
    if abs(number) < 1e-12:
        return 0.0
    return round(number, 12)


def clean_vector(values):
    return [clean_float(value) for value in values]


def correct_world_point(point):
    # Equivalent to Rhino Rotate on WorldXY with origin (0, 0, 0) and angle pi.
    # This rotates about the world Z axis through the origin: (x, y, z) -> (-x, -y, z).
    x, y, z = point
    return clean_vector([-x, -y, z])


def correct_world_rotation(matrix):
    # Active pi-radian WorldXY rotation about origin, equivalent to Rz(pi) * matrix.
    return [
        [-matrix[0][0], -matrix[0][1], -matrix[0][2]],
        [-matrix[1][0], -matrix[1][1], -matrix[1][2]],
        [matrix[2][0], matrix[2][1], matrix[2][2]],
    ]


def transform_cell(xform, row, col):
    try:
        return float(xform[row, col])
    except Exception:
        attr = "M{0}{1}".format(row, col)
        if hasattr(xform, attr):
            return float(getattr(xform, attr))
    raise ValueError("input is not a Rhino transform")


def transform_matrix3(xform):
    return [[transform_cell(xform, row, col) for col in range(3)] for row in range(3)]


def is_identity_transform(xform, tolerance=1e-6):
    try:
        for row in range(4):
            for col in range(4):
                expected = 1.0 if row == col else 0.0
                if abs(transform_cell(xform, row, col) - expected) > tolerance:
                    return False
        return True
    except Exception:
        return False


def normalize_vector(vector):
    length = math.sqrt(sum(value * value for value in vector))
    if length <= EPSILON:
        raise ValueError("zero-length transform axis")
    return [value / length for value in vector]


def rotation_matrix_from_transform(xform):
    matrix = transform_matrix3(xform)
    return [normalize_vector(row) for row in matrix]


def quaternion_from_matrix(matrix):
    m00, m01, m02 = matrix[0]
    m10, m11, m12 = matrix[1]
    m20, m21, m22 = matrix[2]
    trace = m00 + m11 + m22
    if trace > 0.0:
        s = math.sqrt(trace + 1.0) * 2.0
        w = 0.25 * s
        x = (m21 - m12) / s
        y = (m02 - m20) / s
        z = (m10 - m01) / s
    elif m00 > m11 and m00 > m22:
        s = math.sqrt(1.0 + m00 - m11 - m22) * 2.0
        w = (m21 - m12) / s
        x = 0.25 * s
        y = (m01 + m10) / s
        z = (m02 + m20) / s
    elif m11 > m22:
        s = math.sqrt(1.0 + m11 - m00 - m22) * 2.0
        w = (m02 - m20) / s
        x = (m01 + m10) / s
        y = 0.25 * s
        z = (m12 + m21) / s
    else:
        s = math.sqrt(1.0 + m22 - m00 - m11) * 2.0
        w = (m10 - m01) / s
        x = (m02 + m20) / s
        y = (m12 + m21) / s
        z = 0.25 * s
    norm = math.sqrt(x * x + y * y + z * z + w * w)
    if norm <= EPSILON:
        raise ValueError("zero-length quaternion")
    return clean_vector([x / norm, y / norm, z / norm, w / norm])


def quaternion_from_transform(xform):
    corrected_matrix = correct_world_rotation(rotation_matrix_from_transform(xform))
    return quaternion_from_matrix(corrected_matrix)


def rotated_axis(quat, axis):
    x, y, z, w = quat
    norm = math.sqrt(x * x + y * y + z * z + w * w)
    x, y, z, w = x / norm, y / norm, z / norm, w / norm
    ax, ay, az = axis
    return [
        (1.0 - 2.0 * y * y - 2.0 * z * z) * ax + (2.0 * x * y - 2.0 * z * w) * ay + (2.0 * x * z + 2.0 * y * w) * az,
        (2.0 * x * y + 2.0 * z * w) * ax + (1.0 - 2.0 * x * x - 2.0 * z * z) * ay + (2.0 * y * z - 2.0 * x * w) * az,
        (2.0 * x * z - 2.0 * y * w) * ax + (2.0 * y * z + 2.0 * x * w) * ay + (1.0 - 2.0 * x * x - 2.0 * y * y) * az,
    ]


def offset(center, axis, distance):
    return clean_vector([
        center[0] + axis[0] * distance,
        center[1] + axis[1] * distance,
        center[2] + axis[2] * distance,
    ])


def should_flip_axis_order(axis, local_x):
    start = axis.get("start_xyz")
    end = axis.get("end_xyz")
    if not isinstance(start, list) or not isinstance(end, list) or len(start) != 3 or len(end) != 3:
        return False
    try:
        start = [float(value) for value in start]
        end = [float(value) for value in end]
    except Exception:
        return False
    direction = [end[index] - start[index] for index in range(3)]
    return sum(direction[index] * local_x[index] for index in range(3)) < 0.0


def mesh_center(mesh):
    if mesh is None:
        raise ValueError("tracked mesh is missing")
    if hasattr(mesh, "GetBoundingBox"):
        bbox = mesh.GetBoundingBox(True)
        if hasattr(bbox, "IsValid") and not bbox.IsValid:
            raise ValueError("tracked mesh bounding box is invalid")
        center = bbox.Center
        return correct_world_point([center.X, center.Y, center.Z])
    if hasattr(mesh, "Vertices"):
        points = [[v.X, v.Y, v.Z] for v in mesh.Vertices]
        if not points:
            raise ValueError("tracked mesh has no vertices")
        mins = [min(point[index] for point in points) for index in range(3)]
        maxs = [max(point[index] for point in points) for index in range(3)]
        return correct_world_point([(mins[index] + maxs[index]) / 2.0 for index in range(3)])
    raise ValueError("tracked input does not expose mesh geometry")


def find_body(data, object_name):
    bodies = data.get("bodies")
    if not isinstance(bodies, list):
        raise ValueError("hologram model bodies must be a list")
    matches = []
    for index, body in enumerate(bodies):
        if isinstance(body, dict) and canonical_dynamic_name(body.get("id", "")) == object_name:
            matches.append((index, body))
    if not matches:
        raise ValueError("{0}: not found in hologram_model.json".format(object_name))
    if len(matches) > 1:
        raise ValueError("{0}: duplicate bodies in hologram_model.json".format(object_name))
    return matches[0]


def dimensions_for_body(body, object_name):
    solid = body.get("solid")
    if not isinstance(solid, dict):
        raise ValueError("{0}: invalid solid".format(object_name))
    dimensions = solid.get("dimensions")
    if not isinstance(dimensions, dict):
        raise ValueError("{0}: invalid solid dimensions".format(object_name))
    values = {}
    for key in ("x", "y", "z"):
        value = finite_float(dimensions.get(key))
        if value is None:
            raise ValueError("{0}: dimension {1} is not finite".format(object_name, key))
        values[key] = value
    return values


def body_index_by_name(data):
    result = {}
    for index, body in enumerate(data.get("bodies", [])):
        if isinstance(body, dict):
            result[canonical_dynamic_name(body.get("id", ""))] = index
    return result


def mesh_index_for_name(data, object_name, input_names, mesh_list):
    if len(mesh_list) == 1:
        return 0
    if len(input_names) == len(mesh_list):
        for index, input_name in enumerate(input_names):
            if input_name == object_name:
                return index
    indexes = body_index_by_name(data)
    if object_name in indexes and indexes[object_name] < len(mesh_list):
        return indexes[object_name]
    raise ValueError("{0}: cannot map changed name to transformed mesh".format(object_name))


def changed_transform_indexes(orient_list, transl_list):
    changed = []
    for index in range(len(orient_list)):
        if is_identity_transform(orient_list[index]) and is_identity_transform(transl_list[index]):
            continue
        changed.append(index)
    return changed


def event_candidate(data, orient_list, transl_list, input_name_list, mesh_list):
    if not orient_list or not transl_list or not input_name_list or not mesh_list:
        return None, "Waiting for orient/transl/names/tracked_meshes inputs."
    if len(orient_list) != len(transl_list):
        raise ValueError("orient/transl count mismatch: {0}/{1}".format(len(orient_list), len(transl_list)))

    input_names = [canonical_dynamic_name(name) for name in input_name_list]
    if len(input_names) == len(orient_list):
        changed = changed_transform_indexes(orient_list, transl_list)
        if not changed:
            return None, "No changed ModelTracker transform."
        if len(changed) > 1:
            raise ValueError("Expected one changed ModelTracker element, got {0}".format(len(changed)))
        event_index = changed[0]
        object_name = input_names[event_index]
        if event_index >= len(mesh_list):
            raise ValueError("{0}: no tracked mesh at index {1}".format(object_name, event_index))
        return (object_name, event_index, orient_list[event_index]), None

    if len(input_names) == 1 and len(orient_list) == 1:
        object_name = input_names[0]
        if is_identity_transform(orient_list[0]) and is_identity_transform(transl_list[0]):
            return None, "No changed ModelTracker transform."
        mesh_index = mesh_index_for_name(data, object_name, input_names, mesh_list)
        return (object_name, mesh_index, orient_list[0]), None

    raise ValueError(
        "Cannot map ModelTracker event: names={0}, orient={1}, meshes={2}".format(
            len(input_names), len(orient_list), len(mesh_list)
        )
    )


def update_pose_fields(body, object_name, center, quat):
    pose = body.get("pose")
    axis = body.get("axis")
    if not isinstance(pose, dict):
        raise ValueError("{0}: invalid pose".format(object_name))
    if not isinstance(axis, dict):
        raise ValueError("{0}: invalid axis".format(object_name))

    dimensions = dimensions_for_body(body, object_name)
    local_x = normalize_vector(rotated_axis(quat, [1.0, 0.0, 0.0]))
    local_y = normalize_vector(rotated_axis(quat, [0.0, 1.0, 0.0]))
    local_z = normalize_vector(rotated_axis(quat, [0.0, 0.0, 1.0]))

    if should_flip_axis_order(axis, local_x):
        axis_start = offset(center, local_x, dimensions["x"] / 2.0)
        axis_end = offset(center, local_x, -dimensions["x"] / 2.0)
    else:
        axis_start = offset(center, local_x, -dimensions["x"] / 2.0)
        axis_end = offset(center, local_x, dimensions["x"] / 2.0)

    face_bottom = offset(center, local_z, -dimensions["z"] / 2.0)
    face_top = offset(center, local_z, dimensions["z"] / 2.0)
    face_side_a = offset(center, local_y, -dimensions["y"] / 2.0)
    face_side_b = offset(center, local_y, dimensions["y"] / 2.0)

    pose["xyz"] = clean_vector(center)
    pose["quat_xyzw"] = clean_vector(quat)
    axis["start_xyz"] = axis_start
    axis["end_xyz"] = axis_end

    features = body.get("features")
    if isinstance(features, dict):
        update_feature(features, "end_start", world_xyz=axis_start)
        update_feature(features, "end_end", world_xyz=axis_end)
        update_feature(features, "face_bottom", center_xyz=face_bottom, normal_xyz=clean_vector([-local_z[0], -local_z[1], -local_z[2]]))
        update_feature(features, "face_top", center_xyz=face_top, normal_xyz=clean_vector(local_z))
        update_feature(features, "face_side_a", center_xyz=face_side_a, normal_xyz=clean_vector([-local_y[0], -local_y[1], -local_y[2]]))
        update_feature(features, "face_side_b", center_xyz=face_side_b, normal_xyz=clean_vector(local_y))


def update_feature(features, name, world_xyz=None, center_xyz=None, normal_xyz=None):
    feature = features.get(name)
    if not isinstance(feature, dict):
        return
    if world_xyz is not None and "world_xyz" in feature:
        feature["world_xyz"] = clean_vector(world_xyz)
    if center_xyz is not None and "center_xyz" in feature:
        feature["center_xyz"] = clean_vector(center_xyz)
    if normal_xyz is not None and "normal_xyz" in feature:
        feature["normal_xyz"] = clean_vector(normal_xyz)


def write_json_atomic(path, data):
    directory = os.path.dirname(path)
    fd, temp_path = tempfile.mkstemp(prefix=".hologram_model.", suffix=".tmp", dir=directory, text=True)
    try:
        with os.fdopen(fd, "w") as handle:
            json.dump(data, handle, indent=2)
            handle.write("\n")
        os.replace(temp_path, path)
    except Exception:
        if os.path.exists(temp_path):
            os.unlink(temp_path)
        raise


status_lines = []
try:
    orient_list = as_list(orient)
    transl_list = as_list(transl)
    name_list = [str(name) for name in as_list(names)]
    mesh_list = as_list(tracked_meshes)

    with open(HOLOGRAM_MODEL_PATH, "r") as handle:
        model = json.load(handle)

    candidate, status = event_candidate(model, orient_list, transl_list, name_list, mesh_list)
    if candidate is None:
        status_lines.append(status)
    else:
        object_name, mesh_index, orient_xform = candidate
        body_index, body = find_body(model, object_name)
        center = mesh_center(mesh_list[mesh_index])
        quat = quaternion_from_transform(orient_xform)
        update_pose_fields(body, object_name, center, quat)
        write_json_atomic(HOLOGRAM_MODEL_PATH, model)
        status_lines.append(
            "{0}: hologram target updated from mesh index {1}; corrected center=({2:.4f}, {3:.4f}, {4:.4f})".format(
                object_name, mesh_index, center[0], center[1], center[2]
            )
        )
except Exception as exc:
    status_lines.append("No write: {0}".format(exc))

a = "\n".join(status_lines)
print(a)
# ---------- end py3_2 ----------

# ----
panel = Panel(modeltracker.Status)

# ----
# ROBOT KINEMATICS [unit: mm]
plane = Plane(construct_point)
flip_plane = FlipPlane(Plane=plane, ReverseX=False, ReverseY=False, SwapAxes=True)
merge = Merge(Data1=Toggle(False), Data2=Toggle(False), Data3=Toggle(True))
point = Point(Point(-3.536362293, -1.54850738, 0))
define_end_effector = DefineEndEffector(Geometry=stream_filter, TCPFrame=move.Geometry, MountingFrame=PlaneXY(0, 0, 0))
xy_plane_2 = XYPlane(Origin=point)

# ----
# Define Robot
xy_plane_3 = XYPlane(Origin=Point(0, 0, 0))
predefined_universal_robot_ur10 = PredefinedUniversalRobotUR10(BaseFrame=xy_plane_3, EndEffectorOptional=define_end_effector)
links = Panel("""new_ur10_gripper
base_link
base_link_inertia
shoulder_link
upper_arm_link
forearm_link
wrist_1_link
wrist_2_link
wrist_3_link
flange""")
robot = Robot(
    WebsocketObject=wsconnection.WebsocketObject,
    Disable=Button(),
    RobotName="UR10",
    VirtualRobotModelNS=predefined_universal_robot_ur10,
    AxisToggles=merge,
    JointNames=links)  # -> Output, RobotObject

robot_inverse_kinematics = RobotInverseKinematics(Robot=predefined_universal_robot_ur10, TargetTCPFrame=flip_plane, AxisToggles=merge, useColorPreview=True)  # -> PoseGeometry, AxisValues, AxisFrames

# ---- group: just to give it a bit of differentiation
display_rule = DisplayRule(TargetAnchor=robot.RobotObject, anchorType="session")
repeat_data = RepeatData(
    Data=[ColourSwatch(SwatchColor=RGBA(43, 117, 255, 168)), ColourSwatch(SwatchColor=RGBA(73, 255, 13, 146)), ColourSwatch(SwatchColor=RGBA(255, 41, 41, 117))],
    Length="9")

# ---- group: moveit model
scene_mesh_object = SceneMeshObject(TargetAnchor=robot.RobotObject, Meshes=brep_3, Names=concatenate_2, Colours=repeat_data, DisplayRules=display_rule)  # -> Output, MeshGeometryObjects

# ---- group: AR display
scene_mesh_object_2 = SceneMeshObject(
    TargetAnchor=robot.RobotObject,
    Meshes=rotate.Geometry,
    Names=concatenate,
    Colours=repeat_data,
    DisplayRules=display_rule)  # -> Output, MeshGeometryObjects

# ----
construct_scene_content = ConstructSceneContent(Name="cool beams", Meshes=scene_mesh_object_2.MeshGeometryObjects, LevelOfDetail=0)

# ----
# moveit scene
button_2 = Button()
planning_scene_model = PlanningSceneModel(
    Robot=robot.RobotObject,
    SceneGeometries=scene_mesh_object.MeshGeometryObjects,
    TriggerSend=button_2,
    TriggerRemove=Button())

# ----
# AR scene
button_3 = Button()
xr_scene_model = XRSceneModel(
    GHControl=True,
    ARDevices=hololens.ARDevice,
    ContentObjects=construct_scene_content,
    TriggerSend=[button_3, button],
    TriggerRemove=Button(),
    TimeDelay=100)

panel_2 = Panel(planning_scene_model)
