# Grasshopper definition Act_scene_vertical.gh (Grasshopper 1.0.8)
# plug-ins: Virtual Robot, Cassis, Vizor

md_slider = MDSlider(
    SliderMode=0,
    slider_value=Point(0.269776228, 0.7817036699, 0.5),
    x_domain=Domain(0, 1),
    y_domain=Domain(0, 1),
    z_domain=Domain(0, 1))
open_gripper = BooleanToggle(False)

deconstruct = Deconstruct(Point=expr("x*1000", md_slider))  # -> XComponent, YComponent, ZComponent
construct_point = ConstructPoint(XCoordinate=deconstruct.XComponent, YCoordinate=deconstruct.YComponent, ZCoordinate=Slider(150, range=0..1000))

cassis = Cassis(
    Prefix="http://localhost:3003/mcp/",
    EnabledTools="Remove_Script_Parameter,Modify_Script_Component_Parameters,Add_Script_Parameter,List_Python_Scripts,Get_Python_Script,Edit_Python_Script,Get_Python_Script_Errors,Edit_Script,Set_Component_Value,Get_Component_Output,GetAllConnections,ForceDocumentSolution,RecomputeScriptComponents,Get_Components_In_Group,Get_Parameter_TypeHints")
py3 = Python3Script(refresh=Button())  # -> out, geometry; inputs refresh: Boolean
# ---------- py3: Python ----------
#! python 3

"""Load common_model.json and emit Rhino Brep boxes for Grasshopper preview."""
import json
import os

import Rhino.Geometry as rg

gh_path = ghenv.Component.OnPingDocument().FilePath.replace("/", "\\")
gh_dir = gh_path.rsplit("\\", 1)[0]

repo_root = gh_dir.rsplit("\\examples", 1)[0]
DEFAULT_MODEL_PATH = repo_root + r"\server\robot_control\shared_geometry\physical_model.json"


def optional_input(name, fallback=None):
    value = globals().get(name, fallback)
    if value is None:
        return fallback
    text = str(value).strip()
    return text if text else fallback


def point3(values):
    return rg.Point3d(float(values[0]), float(values[1]), float(values[2]))


def unitized(vector, fallback):
    v = rg.Vector3d(vector)
    if v.Length <= 1e-9:
        v = rg.Vector3d(fallback)
    v.Unitize()
    return v


def stable_beam_plane(start, end):
    axis = end - start
    length = axis.Length
    if length <= 1e-9:
        raise ValueError("Beam axis has zero length")

    x_axis = unitized(axis, rg.Vector3d.XAxis)
    up = rg.Vector3d.ZAxis
    ref = rg.Vector3d.YAxis if abs(rg.Vector3d.Multiply(x_axis, up)) > 0.95 else up
    y_axis = rg.Vector3d.CrossProduct(ref, x_axis)
    y_axis = unitized(y_axis, rg.Vector3d.YAxis)

    center = rg.Point3d(
        (start.X + end.X) * 0.5,
        (start.Y + end.Y) * 0.5,
        (start.Z + end.Z) * 0.5,
    )
    return rg.Plane(center, x_axis, y_axis), length


def beam_to_brep(body, default_section):
    axis = body.get("axis") or {}
    start = point3(axis["start_xyz"])
    end = point3(axis["end_xyz"])
    plane, length = stable_beam_plane(start, end)

    dimensions = ((body.get("solid") or {}).get("dimensions") or {})
    section_y = float(dimensions.get("y", default_section.get("y", 0.04)))
    section_z = float(dimensions.get("z", default_section.get("z", 0.04)))

    box = rg.Box(
        plane,
        rg.Interval(-length * 0.5, length * 0.5),
        rg.Interval(-section_y * 0.5, section_y * 0.5),
        rg.Interval(-section_z * 0.5, section_z * 0.5),
    )
    brep = box.ToBrep()
    if brep:
        brep.UserDictionary.Set("common_model_id", body.get("id", ""))
        brep.UserDictionary.Set("common_model_family", body.get("family", ""))
        brep.UserDictionary.Set("common_model_label", body.get("label", ""))
    return brep


model_file = optional_input("model_path", DEFAULT_MODEL_PATH)
if not os.path.exists(model_file):
    raise FileNotFoundError("common_model.json not found: {0}".format(model_file))

with open(model_file, "r", encoding="utf-8") as handle:
    model = json.load(handle)

default_section = (((model.get("defaults") or {}).get("solid") or {}).get("section") or {})
breps = []
labels = []
for body in model.get("bodies", []):
    brep = beam_to_brep(body, default_section)
    if brep:
        breps.append(brep)
        labels.append("{0} ({1}): {2}".format(body.get("id"), body.get("family"), body.get("label")))

geometry = breps
a = breps
print("Loaded {0} beam Breps from {1}".format(len(breps), model_file))
print("Model: {0}".format(model.get("name", "unnamed")))
# ---------- end py3 ----------

# ---- group: physical_model
py3_2 = Python3Script(refresh=Button())  # -> out, geometry; inputs refresh: Boolean
# ---------- py3_2: Python ----------
#! python 3

"""Load common_model.json and emit Rhino Brep boxes for Grasshopper preview."""
import json
import os

import Rhino.Geometry as rg

gh_path = ghenv.Component.OnPingDocument().FilePath.replace("/", "\\")
gh_dir = gh_path.rsplit("\\", 1)[0]

repo_root = gh_dir.rsplit("\\examples", 1)[0]
DEFAULT_MODEL_PATH = repo_root + r"\server\robot_control\shared_geometry\physical_model.json"

def optional_input(name, fallback=None):
    value = globals().get(name, fallback)
    if value is None:
        return fallback
    text = str(value).strip()
    return text if text else fallback


def point3(values):
    return rg.Point3d(float(values[0]), float(values[1]), float(values[2]))


def unitized(vector, fallback):
    v = rg.Vector3d(vector)
    if v.Length <= 1e-9:
        v = rg.Vector3d(fallback)
    v.Unitize()
    return v


def stable_beam_plane(start, end):
    axis = end - start
    length = axis.Length
    if length <= 1e-9:
        raise ValueError("Beam axis has zero length")

    x_axis = unitized(axis, rg.Vector3d.XAxis)
    up = rg.Vector3d.ZAxis
    ref = rg.Vector3d.YAxis if abs(rg.Vector3d.Multiply(x_axis, up)) > 0.95 else up
    y_axis = rg.Vector3d.CrossProduct(ref, x_axis)
    y_axis = unitized(y_axis, rg.Vector3d.YAxis)

    center = rg.Point3d(
        (start.X + end.X) * 0.5,
        (start.Y + end.Y) * 0.5,
        (start.Z + end.Z) * 0.5,
    )
    return rg.Plane(center, x_axis, y_axis), length


def beam_to_brep(body, default_section):
    axis = body.get("axis") or {}
    start = point3(axis["start_xyz"])
    end = point3(axis["end_xyz"])
    plane, length = stable_beam_plane(start, end)

    dimensions = ((body.get("solid") or {}).get("dimensions") or {})
    section_y = float(dimensions.get("y", default_section.get("y", 0.04)))
    section_z = float(dimensions.get("z", default_section.get("z", 0.04)))

    box = rg.Box(
        plane,
        rg.Interval(-length * 0.5, length * 0.5),
        rg.Interval(-section_y * 0.5, section_y * 0.5),
        rg.Interval(-section_z * 0.5, section_z * 0.5),
    )
    brep = box.ToBrep()
    if brep:
        brep.UserDictionary.Set("common_model_id", body.get("id", ""))
        brep.UserDictionary.Set("common_model_family", body.get("family", ""))
        brep.UserDictionary.Set("common_model_label", body.get("label", ""))
    return brep


model_file = optional_input("model_path", DEFAULT_MODEL_PATH)
if not os.path.exists(model_file):
    raise FileNotFoundError("common_model.json not found: {0}".format(model_file))

with open(model_file, "r", encoding="utf-8") as handle:
    model = json.load(handle)

default_section = (((model.get("defaults") or {}).get("solid") or {}).get("section") or {})
breps = []
labels = []
for body in model.get("bodies", []):
    brep = beam_to_brep(body, default_section)
    if brep:
        breps.append(brep)
        labels.append("{0} ({1}): {2}".format(body.get("id"), body.get("family"), body.get("label")))

geometry = breps
a = breps
print("Loaded {0} beam Breps from {1}".format(len(breps), model_file))
print("Model: {0}".format(model.get("name", "unnamed")))
# ---------- end py3_2 ----------

# ----
hologram_model = Python3Script(refresh=Button())  # -> out, geometry; inputs refresh: Boolean
# ---------- hologram_model: Python ----------
#! python 3

"""Load common_model.json and emit Rhino Brep boxes for Grasshopper preview."""
import json
import os

import Rhino.Geometry as rg

gh_path = ghenv.Component.OnPingDocument().FilePath.replace("/", "\\")
gh_dir = gh_path.rsplit("\\", 1)[0]

repo_root = gh_dir.rsplit("\\examples", 1)[0]
DEFAULT_MODEL_PATH = repo_root + r"\server\robot_control\shared_geometry\hologram_model.json"

def optional_input(name, fallback=None):
    value = globals().get(name, fallback)
    if value is None:
        return fallback
    text = str(value).strip()
    return text if text else fallback


def point3(values):
    return rg.Point3d(float(values[0]), float(values[1]), float(values[2]))


def unitized(vector, fallback):
    v = rg.Vector3d(vector)
    if v.Length <= 1e-9:
        v = rg.Vector3d(fallback)
    v.Unitize()
    return v


def stable_beam_plane(start, end):
    axis = end - start
    length = axis.Length
    if length <= 1e-9:
        raise ValueError("Beam axis has zero length")

    x_axis = unitized(axis, rg.Vector3d.XAxis)
    up = rg.Vector3d.ZAxis
    ref = rg.Vector3d.YAxis if abs(rg.Vector3d.Multiply(x_axis, up)) > 0.95 else up
    y_axis = rg.Vector3d.CrossProduct(ref, x_axis)
    y_axis = unitized(y_axis, rg.Vector3d.YAxis)

    center = rg.Point3d(
        (start.X + end.X) * 0.5,
        (start.Y + end.Y) * 0.5,
        (start.Z + end.Z) * 0.5,
    )
    return rg.Plane(center, x_axis, y_axis), length


def beam_to_brep(body, default_section):
    axis = body.get("axis") or {}
    start = point3(axis["start_xyz"])
    end = point3(axis["end_xyz"])
    plane, length = stable_beam_plane(start, end)

    dimensions = ((body.get("solid") or {}).get("dimensions") or {})
    section_y = float(dimensions.get("y", default_section.get("y", 0.04)))
    section_z = float(dimensions.get("z", default_section.get("z", 0.04)))

    box = rg.Box(
        plane,
        rg.Interval(-length * 0.5, length * 0.5),
        rg.Interval(-section_y * 0.5, section_y * 0.5),
        rg.Interval(-section_z * 0.5, section_z * 0.5),
    )
    brep = box.ToBrep()
    if brep:
        brep.UserDictionary.Set("common_model_id", body.get("id", ""))
        brep.UserDictionary.Set("common_model_family", body.get("family", ""))
        brep.UserDictionary.Set("common_model_label", body.get("label", ""))
    return brep


model_file = optional_input("model_path", DEFAULT_MODEL_PATH)
if not os.path.exists(model_file):
    raise FileNotFoundError("common_model.json not found: {0}".format(model_file))

with open(model_file, "r", encoding="utf-8") as handle:
    model = json.load(handle)

default_section = (((model.get("defaults") or {}).get("solid") or {}).get("section") or {})
breps = []
labels = []
for body in model.get("bodies", []):
    brep = beam_to_brep(body, default_section)
    if brep:
        breps.append(brep)
        labels.append("{0} ({1}): {2}".format(body.get("id"), body.get("family"), body.get("label")))

geometry = breps
a = breps
print("Loaded {0} beam Breps from {1}".format(len(breps), model_file))
print("Model: {0}".format(model.get("name", "unnamed")))
# ---------- end hologram_model ----------

xy_plane = XYPlane(Origin=Point(0, 0, 0))
unit_z = UnitZ(Factor="157.5")
move = Move(Geometry=xy_plane, Motion=unit_z)  # -> Geometry, Transform

# ---- group: Open
mesh = Mesh(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)

# ----
mesh_2 = Mesh(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)
stream_filter = StreamFilter(Gate=open_gripper, Stream0=mesh, Stream1=mesh_2)

xy = XYPlane(Origin=Point(0, 0, 0))
brep = Brep(hologram_model.geometry)
item = ListItem(List=brep, Index=0, Wrap=True)  # -> Item, Item1, Item2, Item3, Item4, Item5
rad = Radians(Degrees=Slider(90, range=0..100))
yz = YZPlane(Origin=Point(0, 0, 0))
brep_2 = Brep(item.Item1)
Z = UnitZ(Factor=Slider(0.02, range=0..0.1))
move_2 = Move(Geometry=brep_2, Motion=Z)  # -> Geometry, Transform

panel = Panel("pi")
series = Series(Start=0, Step=1, Count="9")
rotate = Rotate(Geometry=brep, Angle=1.570796327, Plane=PlaneXY(0, 0, 0))  # -> Geometry, Transform
concatenate = Concatenate(FragmentA="dynamic_snappy-V44B80_box", FragmentB=series)

concatenate_2 = Concatenate(FragmentA="dynamic_", FragmentB=series)
Z_2 = UnitZ(Factor="0, 0, 0.09")

# ---- group: make sure this is true for listening
toggle = BooleanToggle(False)

# ----
neg = Negative(Value=Z_2)
move_3 = Move(Geometry=brep, Motion=neg)  # -> Geometry, Transform

# ---- group: physical
brep_3 = Brep(move_2.Geometry)

# ----
brep_4 = Brep(brep)
wsconnection = WsConnection(Address="ws://localhost:9090", Reset=Button())  # -> WebsocketObject, ConnectionInfo

# ---- group: Reset UR10
publish_topic = PublishTopic(
    WSC=wsconnection.WebsocketObject,
    TopicName="/Robot/reset",
    MessageType="std_msgs/String",
    Message="UR10",
    Publish=Button())

# ----
hololens = Hololens(
    WebsocketObject=wsconnection.WebsocketObject,
    Disable=False,
    DeviceName="HOLO1",
    SkillConfiguration="{\"monitor\": 1, \"screw\": 1, \"pick\": 1, \"place\": 1}")  # -> Output, ARDevice

# ---- group: model listener
modeltracker = ModelTracker(Online=toggle, ARDevice=hololens.ARDevice, Meshes=brep, Names=concatenate)  # -> Status, Names, DebugTransformsX, DebugTransformsT, TransformedMesh
mesh_3 = Mesh(modeltracker.TransformedMesh)

# ----
# ROBOT KINEMATICS [unit: mm]
plane = Plane(construct_point)
flip_plane = FlipPlane(Plane=plane, ReverseX=False, ReverseY=False, SwapAxes=True)
merge = Merge(Data1=Toggle(False), Data2=Toggle(False), Data3=Toggle(True))
point = Point(Point(-3.536362293, -1.54850738, 0))
define_end_effector = DefineEndEffector(Geometry=stream_filter, TCPFrame=move.Geometry, MountingFrame=PlaneXY(0, 0, 0))
xy_plane_2 = XYPlane(Origin=point)

# ----
# Define Robot
xy_plane_3 = XYPlane(Origin=Point(0, 0, 0))
predefined_universal_robot_ur10 = PredefinedUniversalRobotUR10(BaseFrame=xy_plane_3, EndEffectorOptional=define_end_effector)
links = Panel("""new_ur10_gripper
base_link
base_link_inertia
shoulder_link
upper_arm_link
forearm_link
wrist_1_link
wrist_2_link
wrist_3_link
flange""")
robot = Robot(
    WebsocketObject=wsconnection.WebsocketObject,
    Disable=Button(),
    RobotName="UR10",
    VirtualRobotModelNS=predefined_universal_robot_ur10,
    AxisToggles=merge,
    JointNames=links)  # -> Output, RobotObject

robot_inverse_kinematics = RobotInverseKinematics(Robot=predefined_universal_robot_ur10, TargetTCPFrame=flip_plane, AxisToggles=merge, useColorPreview=True)  # -> PoseGeometry, AxisValues, AxisFrames

# ---- group: just to give it a bit of differentiation
display_rule = DisplayRule(TargetAnchor=robot.RobotObject, anchorType="session")
repeat_data = RepeatData(
    Data=[ColourSwatch(SwatchColor=RGB(148, 185, 255)), ColourSwatch(SwatchColor=RGB(196, 255, 176)), ColourSwatch(SwatchColor=RGB(255, 176, 176))],
    Length="9")

# ---- group: AR display
scene_mesh_object = SceneMeshObject(TargetAnchor=robot.RobotObject, Meshes=brep, Names=concatenate, Colours=repeat_data, DisplayRules=display_rule)  # -> Output, MeshGeometryObjects

# ---- group: moveit model
scene_mesh_object_2 = SceneMeshObject(TargetAnchor=robot.RobotObject, Meshes=brep_3, Names=concatenate_2, Colours=repeat_data, DisplayRules=display_rule)  # -> Output, MeshGeometryObjects

# ----
construct_scene_content = ConstructSceneContent(Name="cool beams", Meshes=scene_mesh_object.MeshGeometryObjects, LevelOfDetail=0)

# ----
# moveit scene
button = Button()
planning_scene_model = PlanningSceneModel(
    Robot=robot.RobotObject,
    SceneGeometries=scene_mesh_object_2.MeshGeometryObjects,
    TriggerSend=button,
    TriggerRemove=Button())

# ----
# AR scene
button_2 = Button()
xr_scene_model = XRSceneModel(
    GHControl=True,
    ARDevices=hololens.ARDevice,
    ContentObjects=construct_scene_content,
    TriggerSend=button_2,
    TriggerRemove=Button(),
    TimeDelay=100)

panel_2 = Panel(planning_scene_model)
