# Grasshopper definition Act_scene_vertical.ghx (Grasshopper 1.0.8)
# plug-ins: Virtual Robot, Cassis, Vizor

md_slider = MDSlider(
    SliderMode=0,
    slider_value=Point(0.269776228, 0.7817036699, 0.5),
    x_domain=Domain(0, 1),
    y_domain=Domain(0, 1),
    z_domain=Domain(0, 1))
open_gripper = BooleanToggle(False)

deconstruct = Deconstruct(Point=expr("x*1000", md_slider))  # -> XComponent, YComponent, ZComponent
construct_point = ConstructPoint(XCoordinate=deconstruct.XComponent, YCoordinate=deconstruct.YComponent, ZCoordinate=Slider(150, range=0..1000))

cassis = Cassis(
    Prefix="http://localhost:3003/mcp/",
    EnabledTools="Remove_Script_Parameter,Modify_Script_Component_Parameters,Add_Script_Parameter,List_Python_Scripts,Get_Python_Script,Edit_Python_Script,Get_Python_Script_Errors,Edit_Script,Set_Component_Value,Get_Component_Output,GetAllConnections,ForceDocumentSolution,RecomputeScriptComponents,Get_Components_In_Group,Get_Parameter_TypeHints")

# ---- group: physical_model
py3 = Python3Script(refresh=Button(), reset=Button())  # -> out, geometry; inputs refresh: Boolean
# ---------- py3: Python ----------
#! python 3

"""Load physical_model.json and emit Rhino Brep boxes for Grasshopper preview."""
import json
import os
import shutil

import Rhino.Geometry as rg
import System


def ensure_reset_input():
    component = ghenv.Component
    for param in component.Params.Input:
        if param.Name == "reset" or param.NickName == "reset":
            param.Name = "reset"
            param.NickName = "reset"
            param.Optional = True
            return False
    if component.Params.Input.Count == 0:
        raise RuntimeError("Cannot add reset input without a script input template")
    template = component.Params.Input[0]
    param = System.Activator.CreateInstance(template.GetType())
    param.Name = "reset"
    param.NickName = "reset"
    param.Optional = True
    param.Description = "Wire a Button here to reload physical_model.json from physical_model - Copy.json."
    component.Params.RegisterInputParam(param, component.Params.Input.Count)
    component.Params.OnParametersChanged()
    component.ExpireSolution(True)
    return True


def optional_input(name, fallback=None):
    value = globals().get(name, fallback)
    if value is None:
        return fallback
    text = str(value).strip()
    return text if text else fallback


def optional_bool(name, fallback=False):
    value = globals().get(name, fallback)
    if value is None:
        return fallback
    if isinstance(value, bool):
        return value
    text = str(value).strip().lower()
    if not text:
        return fallback
    return text in ("1", "true", "yes", "on")


def point3(values):
    return rg.Point3d(float(values[0]), float(values[1]), float(values[2]))


def unitized(vector, fallback):
    v = rg.Vector3d(vector)
    if v.Length <= 1e-9:
        v = rg.Vector3d(fallback)
    v.Unitize()
    return v


def stable_beam_plane(start, end):
    axis = end - start
    length = axis.Length
    if length <= 1e-9:
        raise ValueError("Beam axis has zero length")

    x_axis = unitized(axis, rg.Vector3d.XAxis)
    up = rg.Vector3d.ZAxis
    ref = rg.Vector3d.YAxis if abs(rg.Vector3d.Multiply(x_axis, up)) > 0.95 else up
    y_axis = rg.Vector3d.CrossProduct(ref, x_axis)
    y_axis = unitized(y_axis, rg.Vector3d.YAxis)

    center = rg.Point3d(
        (start.X + end.X) * 0.5,
        (start.Y + end.Y) * 0.5,
        (start.Z + end.Z) * 0.5,
    )
    return rg.Plane(center, x_axis, y_axis), length


def beam_to_brep(body, default_section):
    axis = body.get("axis") or {}
    start = point3(axis["start_xyz"])
    end = point3(axis["end_xyz"])
    plane, length = stable_beam_plane(start, end)

    dimensions = ((body.get("solid") or {}).get("dimensions") or {})
    section_y = float(dimensions.get("y", default_section.get("y", 0.04)))
    section_z = float(dimensions.get("z", default_section.get("z", 0.04)))

    box = rg.Box(
        plane,
        rg.Interval(-length * 0.5, length * 0.5),
        rg.Interval(-section_y * 0.5, section_y * 0.5),
        rg.Interval(-section_z * 0.5, section_z * 0.5),
    )
    brep = box.ToBrep()
    if brep:
        brep.UserDictionary.Set("common_model_id", body.get("id", ""))
        brep.UserDictionary.Set("common_model_family", body.get("family", ""))
        brep.UserDictionary.Set("common_model_label", body.get("label", ""))
    return brep


gh_path = ghenv.Component.OnPingDocument().FilePath.replace("/", "\\")
gh_dir = gh_path.rsplit("\\", 1)[0]
repo_root = gh_dir.rsplit("\\examples", 1)[0]
DEFAULT_MODEL_PATH = repo_root + r"\server\robot_control\shared_geometry\physical_model.json"
DEFAULT_RESET_MODEL_PATH = repo_root + r"\server\robot_control\shared_geometry\physical_model - Copy.json"

added_reset_input = ensure_reset_input()
model_file = optional_input("model_path", DEFAULT_MODEL_PATH)
reset_file = DEFAULT_RESET_MODEL_PATH
if optional_bool("reset"):
    if not os.path.exists(reset_file):
        raise FileNotFoundError("reset model copy not found: {0}".format(reset_file))
    with open(reset_file, "r", encoding="utf-8") as handle:
        json.load(handle)
    shutil.copyfile(reset_file, model_file)
    print("Reset {0} from {1}".format(model_file, reset_file))

if not os.path.exists(model_file):
    raise FileNotFoundError("common_model.json not found: {0}".format(model_file))

with open(model_file, "r", encoding="utf-8") as handle:
    model = json.load(handle)

default_section = (((model.get("defaults") or {}).get("solid") or {}).get("section") or {})
breps = []
labels = []
for body in model.get("bodies", []):
    brep = beam_to_brep(body, default_section)
    if brep:
        breps.append(brep)
        labels.append("{0} ({1}): {2}".format(body.get("id"), body.get("family"), body.get("label")))

geometry = breps
a = breps
if added_reset_input:
    print("Added reset input. Wire a Button to it, then press reset to reload the copy JSON.")
print("Loaded {0} beam Breps from {1}".format(len(breps), model_file))
print("Model: {0}".format(model.get("name", "unnamed")))
# ---------- end py3 ----------

# ----
hologram_model = Python3Script(refresh=Button(), reset=Button())  # -> out, geometry; inputs refresh: Boolean
# ---------- hologram_model: Python ----------
#! python 3

"""Load hologram_model.json and emit Rhino Brep boxes for Grasshopper preview."""
import json
import os
import shutil

import Rhino.Geometry as rg
import System


def ensure_reset_input():
    component = ghenv.Component
    for param in component.Params.Input:
        if param.Name == "reset" or param.NickName == "reset":
            param.Name = "reset"
            param.NickName = "reset"
            param.Optional = True
            return False
    if component.Params.Input.Count == 0:
        raise RuntimeError("Cannot add reset input without a script input template")
    template = component.Params.Input[0]
    param = System.Activator.CreateInstance(template.GetType())
    param.Name = "reset"
    param.NickName = "reset"
    param.Optional = True
    param.Description = "Wire a Button here to reload hologram_model.json from hologram_model - Copy.json."
    component.Params.RegisterInputParam(param, component.Params.Input.Count)
    component.Params.OnParametersChanged()
    component.ExpireSolution(True)
    return True


def optional_input(name, fallback=None):
    value = globals().get(name, fallback)
    if value is None:
        return fallback
    text = str(value).strip()
    return text if text else fallback


def optional_bool(name, fallback=False):
    value = globals().get(name, fallback)
    if value is None:
        return fallback
    if isinstance(value, bool):
        return value
    text = str(value).strip().lower()
    if not text:
        return fallback
    return text in ("1", "true", "yes", "on")


def point3(values):
    return rg.Point3d(float(values[0]), float(values[1]), float(values[2]))


def unitized(vector, fallback):
    v = rg.Vector3d(vector)
    if v.Length <= 1e-9:
        v = rg.Vector3d(fallback)
    v.Unitize()
    return v


def stable_beam_plane(start, end):
    axis = end - start
    length = axis.Length
    if length <= 1e-9:
        raise ValueError("Beam axis has zero length")

    x_axis = unitized(axis, rg.Vector3d.XAxis)
    up = rg.Vector3d.ZAxis
    ref = rg.Vector3d.YAxis if abs(rg.Vector3d.Multiply(x_axis, up)) > 0.95 else up
    y_axis = rg.Vector3d.CrossProduct(ref, x_axis)
    y_axis = unitized(y_axis, rg.Vector3d.YAxis)

    center = rg.Point3d(
        (start.X + end.X) * 0.5,
        (start.Y + end.Y) * 0.5,
        (start.Z + end.Z) * 0.5,
    )
    return rg.Plane(center, x_axis, y_axis), length


def beam_to_brep(body, default_section):
    axis = body.get("axis") or {}
    start = point3(axis["start_xyz"])
    end = point3(axis["end_xyz"])
    plane, length = stable_beam_plane(start, end)

    dimensions = ((body.get("solid") or {}).get("dimensions") or {})
    section_y = float(dimensions.get("y", default_section.get("y", 0.04)))
    section_z = float(dimensions.get("z", default_section.get("z", 0.04)))

    box = rg.Box(
        plane,
        rg.Interval(-length * 0.5, length * 0.5),
        rg.Interval(-section_y * 0.5, section_y * 0.5),
        rg.Interval(-section_z * 0.5, section_z * 0.5),
    )
    brep = box.ToBrep()
    if brep:
        brep.UserDictionary.Set("common_model_id", body.get("id", ""))
        brep.UserDictionary.Set("common_model_family", body.get("family", ""))
        brep.UserDictionary.Set("common_model_label", body.get("label", ""))
    return brep


gh_path = ghenv.Component.OnPingDocument().FilePath.replace("/", "\\")
gh_dir = gh_path.rsplit("\\", 1)[0]
repo_root = gh_dir.rsplit("\\examples", 1)[0]
DEFAULT_MODEL_PATH = repo_root + r"\server\robot_control\shared_geometry\hologram_model.json"
DEFAULT_RESET_MODEL_PATH = repo_root + r"\server\robot_control\shared_geometry\hologram_model - Copy.json"

added_reset_input = ensure_reset_input()
model_file = optional_input("model_path", DEFAULT_MODEL_PATH)
reset_file = DEFAULT_RESET_MODEL_PATH
if optional_bool("reset"):
    if not os.path.exists(reset_file):
        raise FileNotFoundError("reset model copy not found: {0}".format(reset_file))
    with open(reset_file, "r", encoding="utf-8") as handle:
        json.load(handle)
    shutil.copyfile(reset_file, model_file)
    print("Reset {0} from {1}".format(model_file, reset_file))

if not os.path.exists(model_file):
    raise FileNotFoundError("common_model.json not found: {0}".format(model_file))

with open(model_file, "r", encoding="utf-8") as handle:
    model = json.load(handle)

default_section = (((model.get("defaults") or {}).get("solid") or {}).get("section") or {})
breps = []
labels = []
for body in model.get("bodies", []):
    brep = beam_to_brep(body, default_section)
    if brep:
        breps.append(brep)
        labels.append("{0} ({1}): {2}".format(body.get("id"), body.get("family"), body.get("label")))

geometry = breps
a = breps
if added_reset_input:
    print("Added reset input. Wire a Button to it, then press reset to reload the copy JSON.")
print("Loaded {0} beam Breps from {1}".format(len(breps), model_file))
print("Model: {0}".format(model.get("name", "unnamed")))
# ---------- end hologram_model ----------

xy_plane = XYPlane(Origin=Point(0, 0, 0))
unit_z = UnitZ(Factor="157.5")
move = Move(Geometry=xy_plane, Motion=unit_z)  # -> Geometry, Transform

# ---- group: Open
mesh = Mesh(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)

# ----
mesh_2 = Mesh(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)
stream_filter = StreamFilter(Gate=open_gripper, Stream0=mesh, Stream1=mesh_2)

brep = Brep(hologram_model.geometry)
xy = XYPlane(Origin=Point(0, 0, 0))
Z = UnitZ(Factor=Slider(0.09, range=0..0.1))
planesrf = PlaneSurface(Plane=xy, XSize=Domain(-10, 10), YSize=Domain(-10, 10))
neg = Negative(Value=Z)
move_2 = Move(Geometry=planesrf, Motion=neg)  # -> Geometry, Transform

series = Series(Start=0, Step=1, Count="9")
rotate = Rotate(Geometry=brep, Angle=1.570796327, Plane=PlaneXY(0, 0, 0))  # -> Geometry, Transform
concatenate = Concatenate(FragmentA="dynamic_snappy-V44B80_box", FragmentB=series)

concatenate_2 = Concatenate(FragmentA="dynamic_", FragmentB=series)
Z_2 = UnitZ(Factor="0, 0, 0.09")
neg_2 = Negative(Value=Z_2)
move_3 = Move(Geometry=rotate.Geometry, Motion=neg_2)  # -> Geometry, Transform
brep_2 = Brep(rotate.Geometry)

# ---- group: physical
brep_3 = Brep(py3.geometry)

# ---- group: make sure this is true for listening
toggle = BooleanToggle(False)

# ----
wsconnection = WsConnection(Address="ws://localhost:9090", Reset=Button())  # -> WebsocketObject, ConnectionInfo

# ---- group: Reset UR10
publish_topic = PublishTopic(
    WSC=wsconnection.WebsocketObject,
    TopicName="/Robot/reset",
    MessageType="std_msgs/String",
    Message="UR10",
    Publish=Button())

# ----
hololens = Hololens(
    WebsocketObject=wsconnection.WebsocketObject,
    Disable=False,
    DeviceName="HOLO1",
    SkillConfiguration="{\"monitor\": 1, \"screw\": 1, \"pick\": 1, \"place\": 1}")  # -> Output, ARDevice

# ---- group: model listener
modeltracker = ModelTracker(Online=toggle, ARDevice=hololens.ARDevice, Meshes=rotate.Geometry, Names=concatenate)  # -> Status, Names, DebugTransformsX, DebugTransformsT, TransformedMesh
mesh_3 = Mesh(modeltracker.TransformedMesh)

# ----
# ROBOT KINEMATICS [unit: mm]
plane = Plane(construct_point)
flip_plane = FlipPlane(Plane=plane, ReverseX=False, ReverseY=False, SwapAxes=True)
merge = Merge(Data1=Toggle(False), Data2=Toggle(False), Data3=Toggle(True))
point = Point(Point(-3.536362293, -1.54850738, 0))
define_end_effector = DefineEndEffector(Geometry=stream_filter, TCPFrame=move.Geometry, MountingFrame=PlaneXY(0, 0, 0))
xy_plane_2 = XYPlane(Origin=point)

# ----
# Define Robot
xy_plane_3 = XYPlane(Origin=Point(0, 0, 0))
predefined_universal_robot_ur10 = PredefinedUniversalRobotUR10(BaseFrame=xy_plane_3, EndEffectorOptional=define_end_effector)
links = Panel("""new_ur10_gripper
base_link
base_link_inertia
shoulder_link
upper_arm_link
forearm_link
wrist_1_link
wrist_2_link
wrist_3_link
flange""")
robot = Robot(
    WebsocketObject=wsconnection.WebsocketObject,
    Disable=Button(),
    RobotName="UR10",
    VirtualRobotModelNS=predefined_universal_robot_ur10,
    AxisToggles=merge,
    JointNames=links)  # -> Output, RobotObject

robot_inverse_kinematics = RobotInverseKinematics(Robot=predefined_universal_robot_ur10, TargetTCPFrame=flip_plane, AxisToggles=merge, useColorPreview=True)  # -> PoseGeometry, AxisValues, AxisFrames

# ---- group: just to give it a bit of differentiation
display_rule = DisplayRule(TargetAnchor=robot.RobotObject, anchorType="session")
repeat_data = RepeatData(
    Data=[ColourSwatch(SwatchColor=RGB(148, 185, 255)), ColourSwatch(SwatchColor=RGB(196, 255, 176)), ColourSwatch(SwatchColor=RGB(255, 176, 176))],
    Length="9")

# ---- group: AR display
scene_mesh_object = SceneMeshObject(
    TargetAnchor=robot.RobotObject,
    Meshes=rotate.Geometry,
    Names=concatenate,
    Colours=repeat_data,
    DisplayRules=display_rule)  # -> Output, MeshGeometryObjects

# ---- group: moveit model
scene_mesh_object_2 = SceneMeshObject(TargetAnchor=robot.RobotObject, Meshes=brep_3, Names=concatenate_2, Colours=repeat_data, DisplayRules=display_rule)  # -> Output, MeshGeometryObjects

# ----
construct_scene_content = ConstructSceneContent(Name="cool beams", Meshes=scene_mesh_object.MeshGeometryObjects, LevelOfDetail=0)

# ----
# moveit scene
button = Button()
planning_scene_model = PlanningSceneModel(
    Robot=robot.RobotObject,
    SceneGeometries=scene_mesh_object_2.MeshGeometryObjects,
    TriggerSend=button,
    TriggerRemove=Button())

# ----
# AR scene
button_2 = Button()
xr_scene_model = XRSceneModel(
    GHControl=True,
    ARDevices=hololens.ARDevice,
    ContentObjects=construct_scene_content,
    TriggerSend=button_2,
    TriggerRemove=Button(),
    TimeDelay=100)

panel = Panel(planning_scene_model)
